# Grasshopper definition workflow_prototype.gh (Grasshopper 0.9.76)
# plug-ins: Python Interpreter

# ---- group: workflow1 / set wind tunnel parameters
# Workflow I
wtpar = PythonScript()  # -> ReadMe, WTPar

# ---- group: set boundary condition for outlet
outletpar = PythonScript()

# ---- group: set boundary condition for inlet
# Workflow II
inletpar = PythonScript()  # -> ReadMe, InletPar

# ---- group: workflow1 / set boundary condition for inlet
inletpar_2 = PythonScript()  # -> ReadMe, InletPar

# ---- group: workflow1 / set boundary condition for outlet
outletpar_2 = PythonScript()

# ---- group: default will be wall
creatbfobj = PythonScript()  # -> ReadMe, BFObj

# ---- group: workflow1 / set meshing properties- We may need different ones for different meshing tools
meshingpar = PythonScript()  # -> ReadMe, MeshingPar

# ---- group: set meshing properties- We may need different ones for different meshing tools
meshingpar_2 = PythonScript()  # -> ReadMe, MeshingPar

# ---- group: workflow1 / we need a process to mesh the geometry and read back the mesh for preview
toggle = BooleanToggle(False)

# ---- group: workflow1
# Set/Preview Meshing
toggle_2 = BooleanToggle(False)
brep = Brep()
createwt = PythonScript(_geometry=brep, Rotation_=wtpar.WTPar, InletPar_=inletpar_2.InletPar, OutletPar_=outletpar_2, _createIt=toggle_2)  # -> ReadMe, BFWT
# Create Wind Tunnel (2d/3d)
# 1. Create a wind tunnel based on bounding box size
# 2. Assign inlet/outlet properties
# 3. The output should be ready for meshing
brep_2 = Brep(createwt.BFWT)
bfmeshing = PythonScript(_BFDomain=createwt.BFWT, MeshingPar_=meshingpar.MeshingPar, PreviewMesh_=toggle)  # -> ReadMe, BFDomain
runof = PythonScript(_BFDomain=bfmeshing.BFDomain, Wait_=Toggle(True), _runIt=Toggle(True))  # -> ReadMe, A

# ---- group: we need a process to mesh the geometry and read back the mesh for preview
toggle_3 = BooleanToggle(False)

# ----
# Set/Preview Meshing
creatbfobj_2 = PythonScript(BFSrfPar_=outletpar)  # -> ReadMe, BFObj
creatbfobj_3 = PythonScript(BFSrfPar_=inletpar.InletPar)  # -> ReadMe, BFObj
createwtfromobjs = PythonScript(_BFObjs=[creatbfobj_3.BFObj, creatbfobj_2.BFObj, creatbfobj.BFObj], _createIt=Toggle(False))  # -> ReadMe, BFWT
brep_3 = Brep(createwtfromobjs.BFWT)
bfmeshing_2 = PythonScript(_BFObj=createwtfromobjs.BFWT, MeshingPar_=meshingpar_2.MeshingPar, PreviewMesh_=toggle_3)  # -> ReadMe, BFDomain
runof_2 = PythonScript(_BFDomain=bfmeshing_2.BFDomain, Wait_=Toggle(True), _runIt=Toggle(True))  # -> ReadMe, A
