# Grasshopper definition indoor_and_outdoor_prototype.gh (Grasshopper 0.9.76)
# plug-ins: Python Interpreter

# ---- group: I don't know what to call these
python = PythonScript(Cmu=0.09, kappa=0.4, E=9.8)  # -> epsilonWallFunction
# ---------- python: Python ----------
import sys
sys.path.append("C:/Users/Administrator/Dropbox/ladybug/Butterfly")
from butterfly.fields import EpsilonWallFunction

epsilonWallFunction = EpsilonWallFunction(value, Cmu, kappa, E)
# ---------- end python ----------
python_2 = PythonScript()  # -> nutkWallFunction
# ---------- python_2: Python ----------
import sys
sys.path.append("C:/Users/Administrator/Dropbox/ladybug/Butterfly")
from butterfly.fields import NutkWallFunction

nutkWallFunction = NutkWallFunction(value, Cmu, kappa, E)
# ---------- end python_2 ----------
python_3 = PythonScript(value="0.01")  # -> kqRWallFunction
# ---------- python_3: Python ----------
import sys
sys.path.append("C:/Users/Administrator/Dropbox/ladybug/Butterfly")
from butterfly.fields import KqRWallFunction

if value:
    kqRWallFunction = KqRWallFunction(value)
# ---------- end python_3 ----------
python_4 = PythonScript(value="(0 0 0)")  # -> fixedValue
# ---------- python_4: Python ----------
import sys
sys.path.append("C:/Users/Administrator/Dropbox/ladybug/Butterfly")
from butterfly.fields import FixedValue

if value:
    fixedValue = FixedValue(value)
# ---------- end python_4 ----------
python_5 = PythonScript()  # -> zeroGradient
# ---------- python_5: Python ----------
import sys
sys.path.append("C:/Users/Administrator/Dropbox/ladybug/Butterfly")
from butterfly.fields import ZeroGradient

zeroGradient = ZeroGradient()
# ---------- end python_5 ----------
python_6 = PythonScript()  # -> calculated
# ---------- python_6: Python ----------
import sys
sys.path.append("C:/Users/Administrator/Dropbox/ladybug/Butterfly")
from butterfly.fields import Calculated

calculated = Calculated()
# ---------- end python_6 ----------

# ---- group: create your own
python_7 = PythonScript(bcType="patch", U=python_5, p=python_5, k=python_5, epsilon=python_6, nut=python_6)  # -> out, boundaryFields
# ---------- python_7: Python ----------
import sys
sys.path.append("C:/Users/Administrator/Dropbox/ladybug/Butterfly")

import butterfly
from butterfly import boundarycondition
reload(butterfly)
reload(butterfly.boundarycondition)

if not bcType:
    bcType = 'patch'

boundaryFields = boundarycondition.BoundaryCondition(
    bcType, refLevels=None, u=U, p=p, k=k, epsilon=epsilon, nut=nut
)

boundaryFields = boundaryFields.duplicate()
# ---------- end python_7 ----------

# ----
panel = Panel(python_2)
wall = PythonScript(boundaryFields=python_7.boundaryFields)  # -> BC
# ---------- wall: Python ----------
import sys
sys.path.append("C:/Users/Administrator/Dropbox/ladybug/Butterfly")

import butterfly
from butterfly import boundarycondition as bc

if not refLevels:
    refLevels = (0, 0)

if not boundaryFields:
    BC = bc.BoundaryCondition('patch', refLevels=refLevels)
else:
    boundaryFields.refLevels = refLevels
    BC = boundaryFields.duplicate()
# ---------- end wall ----------
# Download and load butterfly!
panel_2 = Panel("C:/Users/Administrator/Dropbox/ladybug/Butterfly")
vec = VectorXYZ(XComponent="2", YComponent=0, ZComponent=0)  # -> Vector, Length

# ---- group: downloads and installs butterfly if it's not already installed!
buttefly = Buttefly(butterflyFolder=panel_2, update=Toggle(False))  # -> swooooosh; "BF::BF"; inputs update: Boolean
# ---------- buttefly: Python ----------
"""
This component downloads butterfly library from github to:
C:\Users\%USERNAME%\AppData\Roaming\McNeel\Rhinoceros\5.0\scripts\butterfly

-

    Args:
        butterflyFolder_: Optional path to load butterfly libraries instead of the
            installed version
        update_: Optional boolean to update butterfly even if you have it already installed.
    Returns:
        swooooosh: !!!
"""

ghenv.Component.Name = "Buttefly"
ghenv.Component.NickName = "BF::BF"
ghenv.Component.Category = "Butterfly"
ghenv.Component.SubCategory = "00::Create"

import os
import System
import sys
import zipfile
import shutil


def installButterfly(update):
    
    """
    This code will download butterfly library from github to:
        C:\Users\%USERNAME%\AppData\Roaming\McNeel\Rhinoceros\5.0\scripts\butterfly
    """
    url = "https://github.com/mostaphaRoudsari/butterfly/archive/master.zip"
    targetDirectory = [p for p in sys.path if p.find('scripts')!= -1][0]
    libFolder = os.path.join(targetDirectory, r"butterfly")
    
    if not update and os.path.isdir(libFolder):
        return
    elif update and os.path.isdir(libFolder):
        shutil.rmtree(libFolder)
    
    # download the zip file
    print "Downloading the source code..."
    zipFile = os.path.join(targetDirectory, os.path.basename(url))

    try:
        client = System.Net.WebClient()
        client.DownloadFile(url, zipFile)
    except Exception, e:
        msg = `e` + "\nDownload failed! Try to download and unzip the file manually form:\n" + url
        raise Exception(msg)
        
    #unzip the file
    with zipfile.ZipFile(zipFile) as zf:
        for f in zf.namelist():
            if f.endswith('/'):
                try: os.makedirs(f)
                except: pass
            else:
                zf.extract(f, targetDirectory)
    zf.close()
    
    bfFolder = os.path.join(targetDirectory, r"butterfly-master\butterfly")
    shutil.copytree(bfFolder, libFolder)
    
    # try to clean up
    try:
        shutil.rmtree(os.path.join(targetDirectory, 'butterfly-master'))
        os.remove(zipFile)
    except:
        pass


if not butterflyFolder_:
    installButterfly(update_)
elif update_ and not os.path.isdir(butterflyFolder_):
   installButterfly(update_)
elif os.path.isdir(butterflyFolder_) and butterflyFolder_ not in sys.path:
        sys.path.insert(0, butterflyFolder_)


try:
    import butterfly
    print "Imported butterfly from {}\nswoosh swoosh...".format(butterfly.__file__)
    reload(butterfly)
except ImportError as e:
    raise Exception("Failed to import butterfly:\n{}".format(e))
# ---------- end buttefly ----------

# ----
wall_2 = PythonScript(refLevels="(1, 6)")  # -> wallBC
# ---------- wall_2: Python ----------
from butterfly import boundarycondition
wallBC = boundarycondition.IndoorWallBoundaryCondition(refLevels=_refLevels_)
# ---------- end wall_2 ----------
wall_3 = PythonScript(velocityVec=vec.Vector, refLevels="(5, 5)")  # -> inletBC; inputs velocityVec: Vector3d
# ---------- wall_3: Python ----------
import sys
sys.path.append("C:/Users/Administrator/Dropbox/ladybug/Butterfly")

import butterfly
from butterfly import boundarycondition as bc
from butterfly.fields import FixedValue
reload(butterfly)
reload(butterfly.boundarycondition)
#reload(butterfly.fields)

velocityVec = FixedValue(str(tuple(velocityVec)).replace(',', '')) \
              if velocityVec \
              else None

inletBC = bc.FixedInletBoundaryCondition(refLevels=refLevels, u=velocityVec)
# ---------- end wall_3 ----------
wall_4 = PythonScript(refLevels="(5, 5)")  # -> outletBC
# ---------- wall_4: Python ----------
import butterfly
from butterfly import boundarycondition as bc
from butterfly.fields import FixedValue

reload(butterfly)
reload(butterfly.boundarycondition)
pressure = FixedValue(pressure) if pressure else None
outletBC = bc.FixedOutletBoundaryCondition(refLevels=refLevels, p=pressure)
# ---------- end wall_4 ----------
wall_5 = PythonScript(refLevels="(1, 5)")  # -> wallBC
# ---------- wall_5: Python ----------
import butterfly
from butterfly import boundarycondition

reload(butterfly)
reload(butterfly.boundarycondition)

wallBC = boundarycondition.IndoorWallBoundaryCondition(refLevels=refLevels)
# ---------- end wall_5 ----------
panel_3 = Panel(buttefly)
# 0. Create BF surface
brep = Brep([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])
# 1. Wind Tunnel Parameters
jagged = SettingsSpeed()
python_8 = PythonScript(geo=brep, name="buildings", BC=wall_2, meshSet=jagged)  # -> out, BFSrf; inputs geo: list of GeometryBase
# ---------- python_8: Python ----------
from butterfly.gh.bfsurface import BFSurface
if _geo and _name:
    BFSrf = BFSurface(_name, _geo, _BC_, _meshSet_)
# ---------- end python_8 ----------
# Outdoor Study
preview = CustomPreview(
    Geometry=brep,
    Shader={ambient=RGB(0, 0, 0), diffuse=RGB(255, 105, 180), emission=RGB(76, 32, 54), shine=0.5, specular=RGB(255, 255, 255), transparency=0})
python_9 = PythonScript(windwardX=3, topX=3, sidesX=2, leewardX=15, nDivXYZ="{30,5,10}", gradXYZ="{3,1,2}")  # -> out, tunnelPar; inputs nDivXYZ: Point3d, gradXYZ: Point3d
# ---------- python_9: Python ----------
from butterfly.windtunnel import TunnelParameters

tunnelPar = TunnelParameters(_windwardX_, _topX_, _sidesX_, _leewardX_,
                             _nDivXYZ_, _gradXYZ_)
# ---------- end python_9 ----------

# ---- group: inlet!
srf = Surface(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)

# ----
jagged_2 = SettingsSpeed()
brep_2 = Brep(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)
srf_2 = Surface(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)
wires = BrepWireframe(Brep=brep_2, Density=-1)
# Indoor Study
area = Area(Geometry=srf)  # -> Area, Centroid
preview_2 = CustomPreview(Geometry=[srf_2, srf], Shader=ColourSwatch(SwatchColor=RGBA(136, 191, 255, 77)))
# 0. Create BF surfaces
vdis = VectorDisplay(Anchor=area.Centroid, Vector=vec.Vector)
vec_2 = Vector(Vector(47.94345108, 59.67856447, 0))
# 2. Create the Wind Tunnel
panel_4 = Panel("2")
number_slider = Slider(10, range=0..10)
vdis_2 = VectorDisplay(Anchor=Point(0, 0, 0), Vector=vec_2)
python_10 = PythonScript(geo=brep_2, name="room", BC=wall_5, meshSet=jagged_2)  # -> out, BFSrf; inputs geo: list of GeometryBase; same code as python_8
python_11 = PythonScript(geo=srf, name="west_window", BC=wall_3, meshSet=jagged_2)  # -> out, BFSrf; inputs geo: list of GeometryBase; same code as python_8
python_12 = PythonScript(geo=srf_2, name="east_window", BC=wall_4, meshSet=jagged_2)  # -> out, BFSrf; inputs geo: list of GeometryBase; same code as python_8
python_13 = PythonScript(
    name="outdoors_test_4",
    BFSurfaces=python_8.BFSrf,
    windSpeed=panel_4,
    landscape=1,
    globalRefLevel="(2, 6)",
    tunnelPar=python_9.tunnelPar,
    run=Toggle(False))  # -> readMe, geo, case; inputs BFSurfaces: list, windSpeed: Int32, windDirection: Vector3d, landscape: Int32
# ---------- python_13: Python ----------
import butterfly, butterfly.gh.windtunnel
import sys
import types

def reload_package(root_module):
    package_name = root_module.__name__

    # get a reference to each loaded module
    loaded_package_modules = dict([
        (key, value) for key, value in sys.modules.items() 
        if key.startswith(package_name) and isinstance(value, types.ModuleType)])

    # delete references to these loaded modules from sys.modules
    for key in loaded_package_modules:
        del sys.modules[key]

    # load each of the modules again; 
    # make old modules share state with new modules
    for key in loaded_package_modules:
        # print 'loading %s' % key
        newmodule = __import__(key)
        oldmodule = loaded_package_modules[key]
        oldmodule.__dict__.clear()
        oldmodule.__dict__.update(newmodule.__dict__)

def main():
    wt = butterfly.gh.windtunnel.GHWindTunnel(_name, _BFSurfaces, _windSpeed, _windDirection_, _tunnelPar_,
                      _landscape_, _globalRefLevel_)
    geo =  wt.boundingbox
    case = wt.toOpenFOAMCase()
    case.createCaseFolders()
    case.populateContents()
    
    return geo, case


# This is a hack. I should get it fixed soon. Read here for more:
# https://github.com/mostaphaRoudsari/Butterfly/issues/33

if _run and _name and _BFSurfaces and _windSpeed:
    try:
        geo, case = main()
    except TypeError:
        reload_package(butterfly)
        geo, case = main()
# ---------- end python_13 ----------
box = DomainBox(Base=PlaneXY(0, 0, 0), X=number_slider, Y=number_slider, Z=number_slider)
panel_5 = Panel(python_13.readMe)
python_14 = PythonScript(bbox=box, nDivXYZ="{2,2,2}", gradXYZ="{1,1,1}")  # -> blockMeshDict; inputs bbox: GeometryBase, nDivXYZ: Point3d, gradXYZ: Point3d
# ---------- python_14: Python ----------
# import butterfly
from butterfly.gh.bfsurface import BFSurface
from butterfly.gh.block import Block
from butterfly.blockMeshDict import BlockMeshDict
from butterfly.boundarycondition import BoundingBoxBoundaryCondition

# create blockMeshDict based on BBox
if _bbox:
    block = Block(_bbox, _nDivXYZ_, _gradXYZ_)
    bc = BoundingBoxBoundaryCondition()
    BBBFSurface = BFSurface('boundingbox', [_bbox], bc)
    blockMeshDict = BlockMeshDict(1, [BBBFSurface], [block])
# ---------- end python_14 ----------
dom = ConstructDomain(DomainStart="1", DomainEnd="2")

# ---- group: Create and write the case!
# 1. Create an OpenFOAM case
python_15 = PythonScript(
    name="indoor_airflow_0",
    BFSurfaces=flatten([python_10.BFSrf, python_11.BFSrf, python_12.BFSrf]),
    blockMeshDict=python_14,
    globalRefLevel=dom,
    run=Toggle(True))  # -> readMe, case; inputs BFSurfaces: list, run: Boolean
# ---------- python_15: Python ----------
from butterfly.gh.core import Case
#import butterfly
#reload(butterfly.core)
#reload(butterfly.controlDict)
#reload(butterfly.gh.core)

if _run and _name and _BFSurfaces and _blockMeshDict: 
    # create OpenFoam Case
    case = Case(_name, _BFSurfaces, _blockMeshDict, _globalRefLevel_,
                _blockMeshDict.center, isSnappyHexMesh=True)
    
    case.createCaseFolders()
    case.populateContents()
# ---------- end python_15 ----------

# ----
pt = Point([Point(1.933395533, 5.160314456, 1.966949468), Point(7.958785718, 6.157761352, 2.624808354)])
panel_6 = Panel(pt)
panel_7 = Panel(python_15.readMe)
python_16 = PythonScript()
panel_8 = Panel("""simulationType		RAS;


RAS
{

    printCoeffs		on;

    RASModel		RNGkEpsilon;
turbulance""")
# purgeCase
python_17 = PythonScript(case=python_15.case, blockMesh=False, snappyHexMesh=False, results=False)  # inputs blockMesh: Boolean, snappyHexMesh: Boolean, results: Boolean
# ---------- python_17: Python ----------
if _case:
    _case.purge(_blockMesh_, _snappyHexMesh_, _results_)
# ---------- end python_17 ----------

# ---- group: recipe
python_18 = PythonScript(_turbulenceModel_=python_16)  # -> Out, Recipe

# ----
brep_3 = Brep([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])
python_19 = PythonScript(geo=brep_3, nDivXYZ="{1,1,1}", gradXYZ="{1,1,1}")  # -> out, block; inputs geo: Brep, nDivXYZ: Point3d, gradXYZ: Point3d; disabled
# ---------- python_19: Python ----------
import sys
sys.path.append("C:/Users/Administrator/Dropbox/ladybug/Butterfly")

import butterfly
from butterfly.gh import Block

reload(butterfly)
reload(butterfly.gh)

block = Block(geo, nDivXYZ, gradXYZ)
# ---------- end python_19 ----------
wires_2 = BrepWireframe(Brep=brep_3, Density=-1)
python_20 = PythonScript(name="innerflow_2", blocks=python_19.block)  # -> out, c; inputs BFSrfs: list, blocks: list; disabled
# ---------- python_20: Python ----------
import sys
sys.path.append("C:/Users/Administrator/Dropbox/ladybug/Butterfly")

import butterfly
from butterfly.foamfile import FoamFile
from butterfly.core import Case

reload(butterfly)
reload(butterfly.blockMeshDict)
reload(butterfly.foamfile)
reload(butterfly.core)

c = Case.fromBlocks(BFSrfs, blocks, 1)
c.write(name)
# ---------- end python_20 ----------
panel_9 = Panel(python_20.out)

brep_4 = Brep([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])
gentestpts = Honeybee_GenerateTestPoints(testGeometry=brep_4, gridSize=Slider(0.5, range=0..1), distBaseSrf="0.05", moveTestMesh=Toggle(False))  # -> readMe, simplify(testPoints), simplify(ptsVectors), simplify(facesArea), simplify(mesh); plug-in component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
flatten = FlattenTree(Tree=gentestpts.testPoints, Path="{0}")
faceb = FaceBoundaries(Mesh=gentestpts.mesh)
panel_10 = Panel("C:\Users\Administrator\butterfly\atrium2d\3\polyMesh")

panel_11 = Panel("C:\Users\Administrator\Dropbox\ladybug\Butterfly\other_files\OpenFOAM_Sample_Files\innerflow\constant\polyMesh")
python_21 = PythonScript()  # -> out, mesh
# ---------- python_21: Python ----------
import Rhino as rc
import os

def splitLine(l, t=float):
    return tuple(t(s) for s in l.split('(')[-1].replace(')', '').split())

def OFMeshToRhino(studyFolder):
    if not studyFolder:
        return

    pf = os.path.join(studyFolder, 'points')
    ff = os.path.join(studyFolder, 'faces')
    
    if not os.path.isfile(pf) or not os.path.isfile(ff):
        print "Can't find point and faces file."
        return
        
    # read points
    with open(pf, 'rb') as ptFile:
        for l in xrange(17):
            ptFile.readline()
        
        try:
            # blockMesh
            line = ptFile.readline()
            nPoints = int(line[0])
            pts = tuple(
                       rc.Geometry.Point3d(*pt)
                       for pt in eval(line[1:].replace(" ", ", "))
                       )
        except:
            #snappyHexMesh
            line = ptFile.readline()
            nPoints = int(line)
            ptFile.readline()
            pts = tuple(
                       rc.Geometry.Point3d(*splitLine(ptFile.readline()))
                       for pt in xrange(nPoints)
                )

            
    # read faces
    with open(ff, 'rb') as faceFile:
       for l in xrange(18):
           faceFile.readline()
       
       nFaces = int(faceFile.readline())
       faceFile.readline()
       faces = tuple((splitLine(faceFile.readline(), t=int))
                   for pt in xrange(nFaces)
            )
    
    # create the mesh
    mesh = rc.Geometry.Mesh()

    for p in pts:
        mesh.Vertices.Add(p)

    for face in faces:
        if len(face) < 5:
            mesh.Faces.AddFace(*face)
        elif len(face) == 5:
            mesh.Faces.AddFace(*face[:3])
            mesh.Faces.AddFace(*face[:1] + (face[3:]))
        elif len(face) == 8:
            mesh.Faces.AddFace(*face[:4])
            mesh.Faces.AddFace(*(face[0], face[3], face[4], face[7]))
            mesh.Faces.AddFace(*(face[7], face[4], face[5], face[6]))
        else:
            try:
                mesh.Faces.AddFace(*face[:4])
                mesh.Faces.AddFace(*face[:1] + (face[4:]))
            except:
                msg = "One of the faces has %d vertices." % len(face)
                print msg

    return mesh

mesh = OFMeshToRhino(studyFolder)
# ---------- end python_21 ----------
pt_2 = Point(Point(5.246792205, 3.706414975, 3.184472171))
xz = XZPlane(Origin=pt_2)
xy = XYPlane(Origin=pt_2)
yz = YZPlane(Origin=pt_2)
mesh = Mesh(python_21.mesh)
sec = MeshPlane(Mesh=mesh, Plane=xy)

panel_12 = Panel("C:\Users\Administrator\butterfly\innerflow_3\constant\polyMesh")

# ----
# 0. blockMesh
# 1. snappyHexMesh
# 2. simpleFOAM
# This will eventually change to a recipe,
toggle = BooleanToggle(True)
python_22 = PythonScript(castellatedMesh=True, snap=True, addLayers=False, maxGlobalCells=2000000)  # -> snappyHexMeshDict; inputs meshQuality: Int32, castellatedMesh: Boolean, snap: Boolean, addLayers: Boolean, maxGlobalCells: Int32
# ---------- python_22: Python ----------
"""
Set parameters for snappyHexMeshDict.
Read more about snappyHexMeshDict here:
    https://openfoamwiki.net/images/f/f0/Final-AndrewJacksonSlidesOFW7.pdf


    Args:
        _meshQuality_: Use 0-2 to auto generate the parameters for meshQualityControls
        _castellatedMesh_: Set to True to castellated mesh (default: True).
        _snap_: Set to True to snap mesh to the surfaces (default: True).
        _addLayers_: Set to True to push mesh away from surfaces and add layers (default: False).
        _maxGlobalCells_: An intger for the maximum number of global cells (default: 2000000).
    Returns:
        snappyHexMeshDict: Butterfly snappyHexMeshDict.
"""

import butterfly
from butterfly.snappyHexMeshDict import SnappyHexMeshDict
#reload(butterfly)
#reload(butterfly.foamfile)
#reload(butterfly.snappyHexMeshDict)

snappyDict = SnappyHexMeshDict()

if _meshQuality_:
    raise NotImplementedError('MeshQuality is not implemented yet. It will be added soon.')

snappyDict.castellatedMesh = _castellatedMesh_
snappyDict.snap = _snap_
snappyDict.addLayers = _addLayers_

if _maxGlobalCells_:
    snappyDict.maxGlobalCells = str(_maxGlobalCells_)


if additionalParameters_:
    raise NotImplementedError('additionalParameters is not implemented yet. It will be added soon.')

snappyHexMeshDict = snappyDict
# ---------- end python_22 ----------
panel_13 = Panel("""U
p""")
python_23 = PythonScript(p="0.0001", U="0.0001", k="0.0001", epsilon="0.0001")  # -> residualControl
# ---------- python_23: Python ----------
"""
Set parameters for runDict

    Args:
        _p_: Residual control valeus for p (default: 1e-5)
        _U_: Residual control valeus for U (default: 1e-5)
        _k_: Residual control valeus for k (default: 1e-5)
        _epsilon_: Residual control valeus for epsilon (default: 1e-5)
    Returns:
        residualControl: Butterfly ResidualControl.
"""

import butterfly
reload(butterfly)
reload(butterfly.foamfile)
reload(butterfly.fvSolution)
from butterfly.fvSolution import ResidualControl

rc = ResidualControl()

if _p_ is not None:
    rc.p = str(_p_)

if _U_ is not None:
    rc.U = str(_U_)

if _k_ is not None:
    rc.k = str(_k_)

if _epsilon_ is not None:
    rc.epsilon = str(_epsilon_)

residualControl = rc
# ---------- end python_23 ----------
python_24 = PythonScript(pts=flatten, fields=panel_13)  # -> probes; inputs pts: list of Point3d, fields: list, writeInterval: Int32
# ---------- python_24: Python ----------
#import butterfly
#reload(butterfly)
#reload(butterfly.functions)
from butterfly.functions import Probes

if _pts:
    probes = Probes()
    probes.probeLocations = _pts
    probes.fields = _fields_
    probes.writeInterval = _writeInterval_
# ---------- end python_24 ----------
python_25 = PythonScript(startTime=0, endTime=Slider(2000, range=0..10000), writeInterval=100, writeCompression=False)  # -> controlDict; inputs startTime: Int32, endTime: Int32, writeInterval: Int32, writeCompression: Boolean
# ---------- python_25: Python ----------
"""
Set parameters for runDict

    Args:
        _startTime_: Start timestep (default: 0)
        _endTime_: End timestep (default: 1000)
        _writeInterval_: Number of intervals between writing the results
            (default: 100)
        _writeCompression_: Set to True if you want the results to be compressed
            before being written to your machine (default: False).
    Returns:
        controlDict: Butterfly controlDict.
"""

import butterfly
from butterfly.controlDict import ControlDict
#reload(butterfly)
#reload(butterfly.foamfile)
#reload(butterfly.controlDict)

cd = ControlDict()
if _startTime_ is not None:
    cd.startTime = _startTime_

if _endTime_ is not None:
    cd.endTime = _endTime_

if _writeInterval_ is not None:
    cd.writeInterval = _writeInterval_

if _writeCompression_ is not None:
    cd.writeCompression = _writeCompression_

controlDict = cd
# ---------- end python_25 ----------

# ---- group: blockMesh
# Mesh and run the case
python_26 = PythonScript(case=python_15.case, purge=toggle, run=Toggle(False))  # -> readMe, case; inputs purge: Boolean
# ---------- python_26: Python ----------
if _case and _run:
    # remove current snappyHexMeshFolders
    if _purge_:
        _case.removeSnappyHexMeshFolders()
    # run blockMesh
    success, err = _case.blockMesh(removeContent=True)
    if success:
        case = _case
    else:
        raise Exception("\n --> OpenFOAM command Failed!%s" % err)
# ---------- end python_26 ----------

# ---- group: snappyHexMesh
meshguidepoint = PythonScript(case=python_26.case, snappyHexMeshDict=python_22, run=Toggle(False))  # -> out, case; inputs locationInMesh: Point3d
# ---------- meshguidepoint: Python ----------
if _case:
    if not _locationInMesh_:
        _locationInMesh_ = _case.blockMeshDict.center
    else:
        _locationInMesh_ = tuple(_locationInMesh_)

    if _snappyHexMeshDict_ and hasattr(_snappyHexMeshDict_, 'locationInMesh'):
        # update values for snappyHexMeshDict
        _case.snappyHexMeshDict.castellatedMesh = _snappyHexMeshDict_.castellatedMesh
        _case.snappyHexMeshDict.snap = _snappyHexMeshDict_.snap
        _case.snappyHexMeshDict.addLayers = _snappyHexMeshDict_.addLayers
        _case.snappyHexMeshDict.maxGlobalCells = str(_snappyHexMeshDict_.maxGlobalCells)
        
    _case.snappyHexMeshDict.locationInMesh = _locationInMesh_
    
    if _run:
        _case.snappyHexMeshDict.save(_case.projectDir)
        if _case.getSnappyHexMeshFolders():
            _case.copySnappyHexMesh()
        success, err = _case.snappyHexMesh()
        if success:
            case = _case
        else:
            raise Exception("\n --> OpenFOAM command Failed!%s" % err)
# ---------- end meshguidepoint ----------

# ----
# 1.1. checkMesh
python_27 = PythonScript(case=meshguidepoint.case, run=Toggle(True))  # -> readMe, case, maxNonOrthogonality
# ---------- python_27: Python ----------
import os

if _case and _run:
    maxNonOrthogonality, avgNonOrthogonality = _case.calculateMeshOrthogonality()
    print "Mesh non-orthogonality max: {}, Mesh non-orthogonality average: {}".format(maxNonOrthogonality, avgNonOrthogonality)
    case = _case
# ---------- end python_27 ----------
panel_14 = Panel(python_27.readMe)
# 1.2. update fvSchemes based on
# mesh orthogonality
python_28 = PythonScript(case=python_27.case, orthogonality=python_27.maxNonOrthogonality, run=Toggle(False))  # -> readMe, case
# ---------- python_28: Python ----------
if _case and _orthogonality and _run:
    # run blockMesh
    _case.setFvSchemesfromMeshOrthogonality(_orthogonality)
    _case.fvSchemes.save(_case.projectDir)
    print _case.fvSchemes
    case = _case
# ---------- end python_28 ----------

# ---- group: case
# Load mesh,
# points, results
data = Data(meshguidepoint.case)

# ----
python_29 = PythonScript(case=data, load=Toggle(False))  # -> velocityVectors; inputs load: Boolean
# ---------- python_29: Python ----------
if case and load:
    velocityVectors = case.loadVelocity()
# ---------- end python_29 ----------
python_30 = PythonScript(case=data, load=Toggle(False))  # -> mesh; inputs load: Boolean
# ---------- python_30: Python ----------
if case and load:
    case.copySnappyHexMesh()
    mesh = case.loadMesh()
# ---------- end python_30 ----------
python_31 = PythonScript(case=data, load=Toggle(False))  # -> pts; inputs load: Boolean
# ---------- python_31: Python ----------
if case and load:
    case.copySnappyHexMesh()
    pts = case.loadPoints()
# ---------- end python_31 ----------

# ---- group: execute the case - simpleFoam for now
simplefoam = PythonScript(case=python_15.case, controlDict=python_25, residualControl=python_23, probes=python_24, run=Toggle(False))  # -> readMe, case; inputs alternataeOFDicts: list
# ---------- simplefoam: Python ----------
if _case:
    if alternataeOFDicts_:
        raise NotImplementedError('alternataeOFDicts_ will let you to use alternate OpenFOAM dictionaries. Coming soon!')
    
    if _controlDict_ and hasattr(_controlDict_, 'startTime'):
        _case.controlDict.startTime = _controlDict_.startTime
        _case.controlDict.endTime = _controlDict_.endTime
        _case.controlDict.writeInterval = _controlDict_.writeInterval
        _case.controlDict.writeCompression = _controlDict_.writeCompression
        _case.controlDict.save(_case.projectDir)
    
    if _probes_:
        # assign probe to case - it will be also included in controlDict
        _case.probes = _probes_
        _case.probes.save(_case.projectDir)
        _case.controlDict.save(_case.projectDir)
        
    if _residualControl_ and hasattr(_residualControl_, 'p'):
        _case.fvSolution.residualControl(p=_residualControl_.p,
                                         U=_residualControl_.U,
                                         k=_residualControl_.k,
                                         epsilon=_residualControl_.epsilon)
        
        _case.fvSolution.save(_case.projectDir)
        
if _case and _run:
    _case.copySnappyHexMesh()
    _case.renameSnappyHexMeshFolders()
    success, err = _case.simpleFoam()
    _case.renameSnappyHexMeshFolders()

    if success:
        case = _case
    else:
        # rename the folders back
        raise Exception("\n --> OpenFOAM command Failed!%s" % err)
# ---------- end simplefoam ----------

# ----
panel_15 = Panel("C:\Users\Administrator\butterfly\indoor_airflow_3\constant\polyMesh")
panel_16 = Panel("C:\Users\Administrator\butterfly\indoor_airflow_3\1900")
panel_17 = Panel(python_25)
data_2 = Data(simplefoam.case)
python_32 = PythonScript()  # -> vectors
# ---------- python_32: Python ----------
import Rhino as rc
import os

def splitLine(l, t=float):
    return tuple(t(s) for s in l.split('(')[-1].replace(')', '').split())


def loadVectors(studyFolder):
    pf = os.path.join(studyFolder, 'U')
    
    if not os.path.isfile(pf):
        print "Can't find vector file."
        return
        
    # read vectors
    with open(pf, 'rb') as ptFile:
        for l in xrange(21):
            line = ptFile.readline()       
        nVectors = int(line)
        ptFile.readline()
        vectors = tuple(
                   rc.Geometry.Vector3d(*splitLine(ptFile.readline()))
                   for pt in xrange(nVectors)
            )
    return vectors

vectors = loadVectors(studyFolder)
# ---------- end python_32 ----------
python_33 = PythonScript()  # -> pts
# ---------- python_33: Python ----------
import Rhino as rc
import os

def splitLine(l, t=float):
    return tuple(t(s) for s in l.split('(')[-1].replace(')', '').split())


def loadPoints(studyFolder):
    pf = os.path.join(studyFolder, 'points')
    
    if not os.path.isfile(pf):
        print "Can't find point and faces file."
        return
        
    # read points
    with open(pf, 'rb') as ptFile:
        for l in xrange(17):
            ptFile.readline()
        
        try:
            # blockMesh
            line = ptFile.readline()
            nPoints = int(line[0])
            pts = tuple(
                       rc.Geometry.Point3d(*pt)
                       for pt in eval(line[1:].replace(" ", ", "))
                       )
        except:
            #snappyHexMesh
            line = ptFile.readline()
            nPoints = int(line)
            ptFile.readline()
            pts = tuple(
                       rc.Geometry.Point3d(*splitLine(ptFile.readline()))
                       for pt in xrange(nPoints)
                )

    return pts

pts = loadPoints(studyFolder)
# ---------- end python_33 ----------
python_34 = PythonScript(case=data_2, field="p")  # -> values
# ---------- python_34: Python ----------
from Rhino.Geometry import Vector3d
if _case and _field:
    rawValues = _case.loadProbes(_field)
    try:
        values = tuple(Vector3d(*v) for v in rawValues)
    except:
        values = rawValues
# ---------- end python_34 ----------
python_35 = PythonScript(case=data_2, field="U")  # -> values; same code as python_34

# ---- group: vectors
vec_3 = Vector(python_35)

# ---- group: points
pt_3 = Point(flatten)

# ----
vlen = VectorLength(Vector=vec_3)
bnd = Bounds(Numbers=vlen)
scale = Slider(0.27, range=0..1)
remap = RemapNumbers(Value=vlen, Source=bnd, Target=Domain(1, 0))  # -> Mapped, Clipped
gradient = Gradient(
    LowerLimit=0,
    UpperLimit=1,
    Parameter=remap.Mapped,
    stops=[0: RGB(234, 38, 0), 0.25: RGB(234, 126, 0), 0.5: RGB(254, 244, 84), 0.75: RGB(173, 203, 249), 1: RGB(75, 107, 169)])
multiplication = Multiplication(A=vec_3, B=scale)
vdisex = VectorDisplayEx(Point=pt_3, Vector=multiplication, Colour=gradient, Width=Slider(2, range=0..5))

# ----
# Results visualization
flatten_2 = FlattenTree(Tree=gentestpts.mesh, Path="{0}")
mjoin = MeshJoin(Meshes=flatten_2)
ladybug = Ladybug_Ladybug()  # -> Vviiiiiiiiiizzz; plug-in component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
recolormesh = Ladybug_RecolorMesh(analysisResult=python_34, inputMesh=mjoin, analysisTitle="pressure", legendTitle="Pa")  # -> readMe, newMesh, newLegend, legendBasePt, meshColors, legendColors; plug-in component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
