# Grasshopper definition createSimpleBoxCase.gh (Grasshopper 0.9.76)
# plug-ins: Python Interpreter

number_slider = Slider(1, range=0..1)
number_slider_2 = Slider(2, range=0..10)
number_slider_3 = Slider(4, range=0..10)
box = DomainBox(Base=PlaneXY(0, 0, 0), X=Domain(-2, 2), Y=Domain(-0.5, 0.5), Z=Domain(0, 0.25))
python = PythonScript(windwardX=3, topX=3, sidesX=2, leewardX=15)  # -> out, tunnelPar
# ---------- python: Python ----------
class TunnelParameters(object):
    """Wind tunnel parameters."""
    def __init__(self, windward=3, top=3, side=2, leeward=15):
        """Init wind tunnel parameters."""
        self.windward = self.__checkInput(windward)
        self.top = self.__checkInput(top)
        self.side = self.__checkInput(side)
        self.leeward = self.__checkInput(leeward)

    def __checkInput(self, input):
        """Check input values."""
        try:
            _inp = float(input)
        except:
            raise ValueError("Failed to convert %s to a number." % input)
        else:
            assert _inp > 0, "Value (%.2f) should be larger than 0." % _inp
            return _inp

    def ToString(self):
        return self.__repr__()
        
    def __repr__(self):
        return 'WW: %.1fX; T: %.1fX; S: %.1fX; LW: %.1fX;' % (
                self.windward, self.top, self.side, self.leeward)


tunnelPar = TunnelParameters(_windwardX_, _topX_, _sidesX_, _leewardX_)
# ---------- end python ----------
brep = Brep(<brep referenced from the Rhino model>)
python_2 = PythonScript(butterflyFolder="C:/Users/Administrator/Dropbox/ladybug/Butterfly")  # -> out
# ---------- python_2: Python ----------
import sys
sys.path.append(butterflyFolder)

try:
    import butterfly
    print "imported buttefly! swoosh swoosh..."
except ImportError:
    raise "Incorrect butterfly folder. Failed to import butterfly!"
# ---------- end python_2 ----------

# ---- group: I don't know what to call these
python_3 = PythonScript(Cmu=0.09, kappa=0.4, E=9.8)  # -> epsilonWallFunction
# ---------- python_3: Python ----------
import sys
sys.path.append("C:/Users/Administrator/Dropbox/ladybug/Butterfly")
from butterfly.fields import EpsilonWallFunction

epsilonWallFunction = EpsilonWallFunction(value, Cmu, kappa, E)
# ---------- end python_3 ----------
python_4 = PythonScript()  # -> nutkWallFunction
# ---------- python_4: Python ----------
import sys
sys.path.append("C:/Users/Administrator/Dropbox/ladybug/Butterfly")
from butterfly.fields import NutkWallFunction

nutkWallFunction = NutkWallFunction(value, Cmu, kappa, E)
# ---------- end python_4 ----------
python_5 = PythonScript(value="0.01")  # -> kqRWallFunction
# ---------- python_5: Python ----------
import sys
sys.path.append("C:/Users/Administrator/Dropbox/ladybug/Butterfly")
from butterfly.fields import KqRWallFunction

if value:
    kqRWallFunction = KqRWallFunction(value)
# ---------- end python_5 ----------
python_6 = PythonScript(value="(0 0 0)")  # -> fixedValue
# ---------- python_6: Python ----------
import sys
sys.path.append("C:/Users/Administrator/Dropbox/ladybug/Butterfly")
from butterfly.fields import FixedValue

if value:
    fixedValue = FixedValue(value)
# ---------- end python_6 ----------
python_7 = PythonScript()  # -> zeroGradient
# ---------- python_7: Python ----------
import sys
sys.path.append("C:/Users/Administrator/Dropbox/ladybug/Butterfly")
from butterfly.fields import ZeroGradient

zeroGradient = ZeroGradient()
# ---------- end python_7 ----------
python_8 = PythonScript()  # -> calculated
# ---------- python_8: Python ----------
import sys
sys.path.append("C:/Users/Administrator/Dropbox/ladybug/Butterfly")
from butterfly.fields import Calculated

calculated = Calculated()
# ---------- end python_8 ----------

# ----
panel = Panel(python_3)
vec = Vector(Vector(37.64742082, 29.87324603, 0))
pt = ConstructPoint(XCoordinate=0, YCoordinate=0, ZCoordinate=0)
panel_2 = Panel(python_2)
python_9 = PythonScript(geo=brep, windSpeed="2", windDir=vec)  # -> out, geo, case; inputs geo: GeometryBase, windDir: Vector3d
# ---------- python_9: Python ----------
import Rhino as rc
from math import pi as PI


class WindTunnel(object):
    
    def __init__(self, geo, windSpeed, windDirection, tunnelParameters):
        """Init wind tunnel."""
        self.geo = geo
        self.windSpeed = windSpeed
        self.windDirection = windDirection
        self.tunnelParameters = tunnelParameters
    
        self.plane = self.calculatePlane()
    
        # find boundingbox
        self.dimensions, self.boundingbox = self.getBoundingBox()
        
        # scale boundingbox from the projected center based on parameters
        self.tunnelGeometry = self.scaleBoundingBox()

    def calculatePlane(self):
        """calculate base plane for wind tunnel."""
        # create plane based on winDir
        xAxis = rc.Geometry.Vector3d(self.windDirection.X,
                                     self.windDirection.Y,
                                     self.windDirection.Z)
        yAxis = rc.Geometry.Vector3d(xAxis)
        yAxis.Rotate(PI/2, rc.Geometry.Vector3d.ZAxis)
        return rc.Geometry.Plane(rc.Geometry.Point3d.Origin, xAxis, yAxis)
        
    def __getDimension(self, min, max,axis):
        
        perpPlane = rc.Geometry.Plane(self.plane)
        perpPlane.Rotate(PI/2, axis)
        
        maxN = perpPlane.ClosestPoint(max)
        maxN.Z = 0
        minN = perpPlane.ClosestPoint(min)
        minN.Z = 0
        
        return minN.DistanceTo(maxN)
     
    
    def getBoundingBox(self):
        """Get bounding box for a geometry in a plane."""
        
        world = rc.Geometry.Plane.WorldXY
        
        bbox = self.geo.GetBoundingBox(self.plane)
        plane_to_world = rc.Geometry.Transform.ChangeBasis(self.plane, world)
            
        box = bbox.ToBrep()
        box.Transform(plane_to_world)
        
        min = bbox.Min
        min.Transform(plane_to_world)
        
        max = bbox.Max
        max.Transform(plane_to_world)
        
        xDimension = self.__getDimension(min, max, self.plane.XAxis)
        yDimension = self.__getDimension(min, max, self.plane.YAxis)
        zDimension = max.Z - min.Z
        
        return (xDimension, yDimension, zDimension), box


    def scaleBoundingBox(self):
        """Scale original bounding box to create wind tunnel."""
        
        vp = rc.Geometry.VolumeMassProperties.Compute(self.boundingbox)
        
        cenPt = (vp.Centroid.X, vp.Centroid.Y, 0)
        vp.Dispose()
        
        self.plane.Origin = rc.Geometry.Point3d(*cenPt)
        
        xScale = (self.tunnelParameters.front + self.tunnelParameters.back) \
                 * (self.dimensions[2] / self.dimensions[0]) + 1
        
        yScale = (2 * self.tunnelParameters.side
                  * (self.dimensions[2] / self.dimensions[1])) + 1
        
        zScale = self.tunnelParameters.top + 1
        
        _scale = rc.Geometry.Transform.Scale(self.plane, xScale, yScale, zScale)
        
        self.boundingbox.Transform(_scale)
        
        moveVector = ((self.tunnelParameters.back + self.tunnelParameters.front) 
                      / 2 - self.tunnelParameters.front) \
                      * self.plane.XAxis \
                      * self.dimensions[2]
        
        self.boundingbox.Transform(rc.Geometry.Transform.Translation(moveVector.X,
                                                                     moveVector.Y,
                                                                     moveVector.Z))
       
        return self.boundingbox


wt = WindTunnel(_geo, _windSpeed, _windDir_, _tunnelPar_)
geo = wt.tunnelGeometry
# ---------- end python_9 ----------
vdis = VectorDisplay(Anchor=pt, Vector=vec)

# ---- group: create your own
python_10 = PythonScript(bcType="patch", U=python_7, p=python_7, k=python_7, epsilon=python_8, nut=python_8)  # -> out, boundaryFields
# ---------- python_10: Python ----------
import sys
sys.path.append("C:/Users/Administrator/Dropbox/ladybug/Butterfly")

import butterfly
from butterfly import boundarycondition
reload(butterfly)
reload(butterfly.boundarycondition)

if not bcType:
    bcType = 'patch'

boundaryFields = boundarycondition.BoundaryCondition(
    bcType, refLevels=None, u=U, p=p, k=k, epsilon=epsilon, nut=nut
)

boundaryFields = boundaryFields.duplicate()
# ---------- end python_10 ----------

# ----
vec_2 = VectorXYZ(XComponent="2", YComponent=0, ZComponent=0)  # -> Vector, Length
wall = PythonScript(boundaryFields=python_10.boundaryFields)  # -> BC
# ---------- wall: Python ----------
import sys
sys.path.append("C:/Users/Administrator/Dropbox/ladybug/Butterfly")

import butterfly
from butterfly import boundarycondition as bc

if not refLevels:
    refLevels = (0, 0)

if not boundaryFields:
    BC = bc.BoundaryCondition('patch', refLevels=refLevels)
else:
    boundaryFields.refLevels = refLevels
    BC = boundaryFields.duplicate()
# ---------- end wall ----------
wall_2 = PythonScript(velocityVec=vec_2.Vector, refLevels="(5, 5)")  # -> inletBC; inputs velocityVec: Vector3d
# ---------- wall_2: Python ----------
import sys
sys.path.append("C:/Users/Administrator/Dropbox/ladybug/Butterfly")

import butterfly
from butterfly import boundarycondition as bc
from butterfly.fields import FixedValue
reload(butterfly)
reload(butterfly.boundarycondition)
#reload(butterfly.fields)

velocityVec = FixedValue(str(tuple(velocityVec)).replace(',', '')) \
              if velocityVec \
              else None

inletBC = bc.FixedInletBoundaryCondition(refLevels=refLevels, u=velocityVec)
# ---------- end wall_2 ----------
wall_3 = PythonScript(refLevels="(10, 10)")  # -> wallBC
# ---------- wall_3: Python ----------
import butterfly
from butterfly import boundarycondition

reload(butterfly)
reload(butterfly.boundarycondition)

wallBC = boundarycondition.IndoorWallBoundaryCondition(refLevels=refLevels)
# ---------- end wall_3 ----------
wall_4 = PythonScript(refLevels="(5, 5)")  # -> outletBC
# ---------- wall_4: Python ----------
import butterfly
from butterfly import boundarycondition as bc
from butterfly.fields import FixedValue

reload(butterfly)
reload(butterfly.boundarycondition)
pressure = FixedValue(pressure) if pressure else None
outletBC = bc.FixedOutletBoundaryCondition(refLevels=refLevels, p=pressure)
# ---------- end wall_4 ----------
# How to add meshingPar
# to wind tunnel?
python_11 = PythonScript()  # -> out, case
# ---------- python_11: Python ----------
print float('-inf')
# ---------- end python_11 ----------
panel_3 = Panel(wall_4)
jagged = SettingsSpeed()

# ---- group: inlet!
srf = Surface(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)

# ----
srf_2 = Surface(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)
brep_2 = Brep(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)
bbox = BoundingBox(Content=brep_2, Plane=PlaneXY(0, 0, 0))  # -> Box, Box_2
area = Area(Geometry=srf)  # -> Area, Centroid
wires = BrepWireframe(Brep=brep_2, Density=-1)
vdis_2 = VectorDisplay(Anchor=area.Centroid, Vector=vec_2.Vector)
preview = CustomPreview(Geometry=[srf_2, srf], Shader=ColourSwatch(SwatchColor=RGBA(136, 191, 255, 77)))

# ---- group: butterfly face
python_12 = PythonScript(geo=srf, name="west_window", BC=wall_2, meshSet=jagged)  # -> out, BFSrf; inputs geo: list of GeometryBase
# ---------- python_12: Python ----------
import sys
sys.path.append("C:/Users/Administrator/Dropbox/ladybug/Butterfly")

import butterfly
from butterfly.gh import BFSurface

reload(butterfly)
reload(butterfly.gh)

BFSrf = BFSurface(name, geo, BC, meshSet)
# ---------- end python_12 ----------

# ----
python_13 = PythonScript(geo=brep_2, name="room", BC=wall_3, meshSet=jagged)  # -> out, BFSrf; inputs geo: list of GeometryBase; same code as python_12
python_14 = PythonScript(y=bbox.Box, x=[python_12.BFSrf, python_13.BFSrf])  # -> out, a; inputs y: GeometryBase, x: list
# ---------- python_14: Python ----------
# import butterfly
from butterfly.gh import BFSurface, Block
from butterfly.blockMeshDict import BlockMeshDict
#import butterfly
from butterfly.boundarycondition import BoundingBoxBoundaryCondition
#reload(butterfly.blockMeshDict)
#reload(butterfly.boundarycondition)

# create blockMeshDict based on BBox
block = Block(y, (5,5,5), (1,1,1))
blockMeshDict = BlockMeshDict(1, x, [block])

a= blockMeshDict.toOpenFoam()
# ---------- end python_14 ----------
python_15 = PythonScript(geo=srf_2, name="east_window", BC=wall_4, meshSet=jagged)  # -> out, BFSrf; inputs geo: list of GeometryBase; same code as python_12
panel_4 = Panel("""simulationType		RAS;


RAS
{

    printCoeffs		on;

    RASModel		RNGkEpsilon;
turbulance""")
number_slider_4 = Slider(10, range=0..10)
python_16 = PythonScript()
box_2 = DomainBox(Base=PlaneXY(0, 0, 0), X=number_slider_4, Y=number_slider_4, Z=number_slider_4)

# ---- group: recipe
python_17 = PythonScript(_turbulenceModel_=python_16)  # -> Out, Recipe

# ----
python_18 = PythonScript(castellatedMesh=True, snap=True, addLayers=False, maxGlobalCells=2000000)  # -> snappyHexMeshDict; inputs meshQuality: Int32, castellatedMesh: Boolean, snap: Boolean, addLayers: Boolean, maxGlobalCells: Int32
# ---------- python_18: Python ----------
"""
Set parameters for snappyHexMeshDict.
Read more about snappyHexMeshDict here:
    https://openfoamwiki.net/images/f/f0/Final-AndrewJacksonSlidesOFW7.pdf


    Args:
        _meshQuality_: Use 0-2 to auto generate the parameters for meshQualityControls
        _castellatedMesh_: Set to True to castellated mesh (default: True).
        _snap_: Set to True to snap mesh to the surfaces (default: True).
        _addLayers_: Set to True to push mesh away from surfaces and add layers.
            (default: False)
        _maxGlobalCells_: An intger for the maximum number of global cells (default: 2000000).
    Returns:
        snappyHexMeshDict: Butterfly snappyHexMeshDict.
"""

import butterfly
from butterfly.snappyHexMeshDict import SnappyHexMeshDict
#reload(butterfly)
#reload(butterfly.foamfile)
#reload(butterfly.snappyHexMeshDict)

snappyDict = SnappyHexMeshDict()

if _meshQuality_:
    raise NotImplementedError('MeshQuality is not implemented yet. It will be added soon.')

snappyDict.castellatedMesh = _castellatedMesh_
snappyDict.snap = _snap_
snappyDict.addLayers = _addLayers_

if _maxGlobalCells_:
    snappyDict.maxGlobalCells = _maxGlobalCells_


if additionalParameters_:
    raise NotImplementedError('additionalParameters is not implemented yet. It will be added soon.')

snappyHexMeshDict = snappyDict
# ---------- end python_18 ----------
python_19 = PythonScript(bbox=box_2, nDivXYZ="{5,5,5}", gradXYZ="{1,1,1}")  # -> blockMeshDict; inputs bbox: GeometryBase, nDivXYZ: Point3d, gradXYZ: Point3d
# ---------- python_19: Python ----------
# import butterfly
from butterfly.gh import BFSurface, Block
from butterfly.blockMeshDict import BlockMeshDict
#import butterfly
from butterfly.boundarycondition import BoundingBoxBoundaryCondition
#reload(butterfly.blockMeshDict)
#reload(butterfly.boundarycondition)

# create blockMeshDict based on BBox
block = Block(bbox, nDivXYZ, gradXYZ)
bc = BoundingBoxBoundaryCondition()
BBBFSurface = BFSurface('boundingbox', [bbox], bc)
blockMeshDict = BlockMeshDict(1, [BBBFSurface], [block])
# ---------- end python_19 ----------
dom = ConstructDomain(DomainStart="1", DomainEnd="2")

# ---- group: Create and write the case!
# Add refinement regions here!
python_20 = PythonScript(
    name="indoor_airflow_2",
    BFSrfs=flatten([python_13.BFSrf, python_12.BFSrf, python_15.BFSrf]),
    blockMeshDict=python_19,
    globalRefLevel=dom)  # -> out, case; inputs BFSrfs: list; disabled
# ---------- python_20: Python ----------
import butterfly
from butterfly.core import Case
reload(butterfly)
reload(butterfly.gh)
reload(butterfly.foamfile)
reload(butterfly.helper)
reload(butterfly.core)
reload(butterfly.runmanager)
#reload(butterfly.snappyHexMeshDict)
#reload(butterfly.fvSchemes)

# create OpenFoam Case
case = Case(name, BFSrfs, blockMeshDict, globalRefLevel, blockMeshDict.center,
            isSnappyHexMesh=True)

case.createCaseFolders()
case.populateContents()

# run blockMesh
case.blockMesh()
# ---------- end python_20 ----------

# ----
python_21 = PythonScript(startTime=0, endTime=Slider(500, range=0..1000), writeInterval=100, writeCompression=False)  # -> controlDict; inputs startTime: Int32, endTime: Int32, writeInterval: Int32, writeCompression: Boolean
# ---------- python_21: Python ----------
"""
Set parameters for runDict

    Args:
        _startTime_: Start timestep (default: 0)
        _endTime_: End timestep (default: 1000)
        _writeInterval_: Number of intervals between writing the results
            (default: 100)
        _writeCompression_: Set to True if you want the results to be compressed
            before being written to your machine (default: False).
    Returns:
        controlDict: Butterfly controlDict.
"""

import butterfly
from butterfly.controlDict import ControlDict
#reload(butterfly)
#reload(butterfly.foamfile)
#reload(butterfly.controlDict)

cd = ControlDict()
if _startTime_ is not None:
    cd.startTime = _startTime_

if _endTime_ is not None:
    cd.endTime = _endTime_

if _writeInterval_ is not None:
    cd.writeInterval = _writeInterval_

if _writeCompression_ is not None:
    cd.writeCompression = _writeCompression_

controlDict = cd
# ---------- end python_21 ----------

# ---- group: snappyHexMesh
meshguidepoint = PythonScript(snappyHexMeshDict=python_18, run=Toggle(False))  # -> out, case; inputs locationInMesh: Point3d
# ---------- meshguidepoint: Python ----------
if case:
    if not _locationInMesh_:
        _locationInMesh_ = case.blockMeshDict.center
    else:
        _locationInMesh_ = tuple(_locationInMesh_)

    if _snappyHexMeshDict_ and hasattr(_snappyHexMeshDict_, 'locationInMesh'):
        case.snappyHexMeshDict = _snappyHexMeshDict_
        
    case.snappyHexMeshDict.locationInMesh = _locationInMesh_
    case.snappyHexMeshDict.save(case.projectDir)
    if _run:
        case.snappyHexMesh()
# ---------- end meshguidepoint ----------

# ---- group: checkMesh
# Mesh non-orthogonality Max: 56.5827 average: 11.9441
python_22 = PythonScript()  # -> Out, A

# ----
panel_5 = Panel(python_20.out)

brep_3 = Brep([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])
python_23 = PythonScript(geo=brep_3, nDivXYZ="{1,1,1}", gradXYZ="{1,1,1}")  # -> out, block; inputs geo: Brep, nDivXYZ: Point3d, gradXYZ: Point3d; disabled
# ---------- python_23: Python ----------
import sys
sys.path.append("C:/Users/Administrator/Dropbox/ladybug/Butterfly")

import butterfly
from butterfly.gh import Block

reload(butterfly)
reload(butterfly.gh)

block = Block(geo, nDivXYZ, gradXYZ)
# ---------- end python_23 ----------
wires_2 = BrepWireframe(Brep=brep_3, Density=-1)
python_24 = PythonScript(name="innerflow_2", blocks=python_23.block)  # -> out, c; inputs BFSrfs: list, blocks: list; disabled
# ---------- python_24: Python ----------
import sys
sys.path.append("C:/Users/Administrator/Dropbox/ladybug/Butterfly")

import butterfly
from butterfly.foamfile import FoamFile
from butterfly.core import Case

reload(butterfly)
reload(butterfly.blockMeshDict)
reload(butterfly.foamfile)
reload(butterfly.core)

c = Case.fromBlocks(BFSrfs, blocks, 1)
c.write(name)
# ---------- end python_24 ----------
panel_6 = Panel(python_24.out)

# ---- group: execute the case - simpleFoam for now
simplefoam = PythonScript(case=meshguidepoint.case, controlDict=python_21, run=Toggle(False))  # -> out, case
# ---------- simplefoam: Python ----------
if _controlDict_ and hasattr(_controlDict_, 'startTime'):
    case.controlDict = _controlDict_
    case.controlDict.save(case.projectDir)

if run:
    case.copySnappyHexMesh()
    case.renameSnappyHexMeshFolders()
    case.simpleFoam()
    # rename the folders back
    case = case.renameSnappyHexMeshFolders()
# ---------- end simplefoam ----------

# ----
data = Data(meshguidepoint.case)
panel_7 = Panel(simplefoam.case)
python_25 = PythonScript(case=meshguidepoint.case, load=Toggle(False))  # -> velocityVectors; inputs load: Boolean
# ---------- python_25: Python ----------
if case and load:
    velocityVectors = case.loadVelocity()
# ---------- end python_25 ----------
python_26 = PythonScript(case=meshguidepoint.case, load=Toggle(False))  # -> pts; inputs load: Boolean
# ---------- python_26: Python ----------
if case and load:
    case.copySnappyHexMesh()
    pts = case.loadPoints()
# ---------- end python_26 ----------
python_27 = PythonScript(case=data, load=Toggle(False))  # -> mesh; inputs load: Boolean
# ---------- python_27: Python ----------
if case and load:
    case.copySnappyHexMesh()
    mesh = case.loadMesh()
# ---------- end python_27 ----------
pt_2 = Point(Point(4.878056299, 4.533652062, 2.405799131))
xz = XZPlane(Origin=pt_2)
xy = XYPlane(Origin=pt_2)
yz = YZPlane(Origin=pt_2)
mesh = Mesh(python_27)
sec = MeshPlane(Mesh=mesh, Plane=xy)
panel_8 = Panel("C:\Users\Administrator\butterfly\outdoor_0\constant\polyMesh")

panel_9 = Panel("C:\Users\Administrator\Dropbox\ladybug\Butterfly\other_files\OpenFOAM_Sample_Files\innerflow\constant\polyMesh")
python_28 = PythonScript(studyFolder="C:\Users\Administrator\butterfly\atrium2d\3\polyMesh")  # -> out, mesh
# ---------- python_28: Python ----------
import Rhino as rc
import os

def splitLine(l, t=float):
    return tuple(t(s) for s in l.split('(')[-1].replace(')', '').split())

def OFMeshToRhino(studyFolder):
    if not studyFolder:
        return

    pf = os.path.join(studyFolder, 'points')
    ff = os.path.join(studyFolder, 'faces')
    
    if not os.path.isfile(pf) or not os.path.isfile(ff):
        print "Can't find point and faces file."
        return
        
    # read points
    with open(pf, 'rb') as ptFile:
        for l in xrange(17):
            ptFile.readline()
        
        try:
            # blockMesh
            line = ptFile.readline()
            nPoints = int(line[0])
            pts = tuple(
                       rc.Geometry.Point3d(*pt)
                       for pt in eval(line[1:].replace(" ", ", "))
                       )
        except:
            #snappyHexMesh
            line = ptFile.readline()
            nPoints = int(line)
            ptFile.readline()
            pts = tuple(
                       rc.Geometry.Point3d(*splitLine(ptFile.readline()))
                       for pt in xrange(nPoints)
                )

            
    # read faces
    with open(ff, 'rb') as faceFile:
       for l in xrange(18):
           faceFile.readline()
       
       nFaces = int(faceFile.readline())
       faceFile.readline()
       faces = tuple((splitLine(faceFile.readline(), t=int))
                   for pt in xrange(nFaces)
            )
    
    # create the mesh
    mesh = rc.Geometry.Mesh()

    for p in pts:
        mesh.Vertices.Add(p)

    for face in faces:
        if len(face) < 5:
            mesh.Faces.AddFace(*face)
        elif len(face) == 5:
            mesh.Faces.AddFace(*face[:3])
            mesh.Faces.AddFace(*face[:1] + (face[3:]))
        elif len(face) == 8:
            mesh.Faces.AddFace(*face[:4])
            mesh.Faces.AddFace(*(face[0], face[3], face[4], face[7]))
            mesh.Faces.AddFace(*(face[7], face[4], face[5], face[6]))
        else:
            try:
                mesh.Faces.AddFace(*face[:4])
                mesh.Faces.AddFace(*face[:1] + (face[4:]))
            except:
                msg = "One of the faces has %d vertices." % len(face)
                print msg

    return mesh

mesh = OFMeshToRhino(studyFolder)
# ---------- end python_28 ----------
pt_3 = Point(Point(5.246792205, 3.706414975, 3.184472171))
xz_2 = XZPlane(Origin=pt_3)
xy_2 = XYPlane(Origin=pt_3)
yz_2 = YZPlane(Origin=pt_3)
mesh_2 = Mesh(python_28.mesh)
sec_2 = MeshPlane(Mesh=mesh_2, Plane=xy_2)

panel_10 = Panel("C:\Users\Administrator\butterfly\innerflow_3\constant\polyMesh")
python_29 = PythonScript(studyFolder="C:\Users\Administrator\butterfly\outdoor_0\300")  # -> vectors
# ---------- python_29: Python ----------
import Rhino as rc
import os

def splitLine(l, t=float):
    return tuple(t(s) for s in l.split('(')[-1].replace(')', '').split())


def loadVectors(studyFolder):
    pf = os.path.join(studyFolder, 'U')
    
    if not os.path.isfile(pf):
        print "Can't find vector file."
        return
        
    # read vectors
    with open(pf, 'rb') as ptFile:
        for l in xrange(21):
            line = ptFile.readline()       
        nVectors = int(line)
        ptFile.readline()
        vectors = tuple(
                   rc.Geometry.Vector3d(*splitLine(ptFile.readline()))
                   for pt in xrange(nVectors)
            )
    return vectors

vectors = loadVectors(studyFolder)
# ---------- end python_29 ----------
python_30 = PythonScript(studyFolder=panel_8)  # -> pts
# ---------- python_30: Python ----------
import Rhino as rc
import os

def splitLine(l, t=float):
    return tuple(t(s) for s in l.split('(')[-1].replace(')', '').split())


def loadPoints(studyFolder):
    pf = os.path.join(studyFolder, 'points')
    
    if not os.path.isfile(pf):
        print "Can't find point and faces file."
        return
        
    # read points
    with open(pf, 'rb') as ptFile:
        for l in xrange(17):
            ptFile.readline()
        
        try:
            # blockMesh
            line = ptFile.readline()
            nPoints = int(line[0])
            pts = tuple(
                       rc.Geometry.Point3d(*pt)
                       for pt in eval(line[1:].replace(" ", ", "))
                       )
        except:
            #snappyHexMesh
            line = ptFile.readline()
            nPoints = int(line)
            ptFile.readline()
            pts = tuple(
                       rc.Geometry.Point3d(*splitLine(ptFile.readline()))
                       for pt in xrange(nPoints)
                )

    return pts

pts = loadPoints(studyFolder)
# ---------- end python_30 ----------
panel_11 = Panel("result visualization")
panel_12 = Panel(python_28.out)

pt_4 = Point(Point(5.817924118, 24.79410443, 10.17661724))
xz_3 = XZPlane(Origin=pt_4)
xy_3 = XYPlane(Origin=pt_4)
vec_3 = Vector(python_29)
pt_5 = Point(python_30)
num = Number("0.75")

yz_3 = YZPlane(Origin=pt_4)
pln = Plane(yz_3)

project = Project(Geometry=pt_5, Plane=pln)  # -> Geometry, Transform
dist = Distance(PointA=project.Geometry, PointB=pt_5)
smaller = SmallerThan(FirstNumber=dist, SecondNumber=num)  # -> SmallerThan, OrEqualTo
cull = CullPattern(List=vec_3, CullPattern=smaller.OrEqualTo)
vlen = VectorLength(Vector=cull)
bnd = Bounds(Numbers=vlen)
remap = RemapNumbers(Value=cull, Source=bnd, Target=Domain(1, 0))  # -> Mapped, Clipped
gradient = Gradient(
    LowerLimit=0,
    UpperLimit=1,
    Parameter=remap.Mapped,
    stops=[0: RGB(234, 38, 0), 0.25: RGB(234, 126, 0), 0.5: RGB(254, 244, 84), 0.75: RGB(173, 203, 249), 1: RGB(75, 107, 169)])
cull_2 = CullPattern(List=pt_5, CullPattern=smaller.OrEqualTo)
cull_3 = CullPattern(List=vec_3, CullPattern=smaller.OrEqualTo)
vdisex = VectorDisplayEx(Point=cull_2, Vector=cull_3, Colour=gradient, Width=Slider(1, range=0..1))

del = DelaunayMesh(Points=cull_2, Plane=pln)
mcol = MeshColours(Mesh=del, Colours=gradient)
