# Grasshopper definition exportHBToSTL.gh (Grasshopper 0.9.76)
# plug-ins: Python Interpreter

honeybee = Honeybee_Honeybee()  # -> Vviiiiiiiiiizzz; plug-in component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
ladybug = Ladybug_Ladybug()  # -> Vviiiiiiiiiizzz; plug-in component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
brep = Brep(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)
panel = Panel("""eastWindow
westWindow""")
mass2zone = Honeybee_Masses2Zones(zoneMasses=flatten(brep), isConditioned=True, maxRoofAngle=30, createHBZones=Toggle(True))  # -> readMe, HBZones; plug-in component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
panel_2 = Panel("""zone_2
zone_3""")
brep_2 = Brep(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)
brep_3 = Brep([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])
brep_4 = Brep([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])
mass2zone_2 = Honeybee_Masses2Zones(zoneMasses=flatten(brep_3), zoneNames=panel_2, isConditioned=True, maxRoofAngle=30, createHBZones=Toggle(True))  # -> readMe, HBZones; plug-in component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
addhbglz = Honeybee_addHBGlz(HBObj=mass2zone.HBZones, childSurfaces=flatten(brep_4), childSurfacesName=flatten(panel))  # -> simplify(HBObjWGLZ); plug-in component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
createhbsrfs = Honeybee_createHBSrfs(geometry=brep_2, srfName="curveSurface")  # -> readMe, simplify(HBSurface); plug-in component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
item = ListItem(List=reverse(mass2zone_2.HBZones), Index=0, Wrap=True)
wires = BrepWireframe(Brep=[item, addhbglz, createhbsrfs.HBSurface], Density=-1)
python = PythonScript(HBObjects=flatten([item, addhbglz, createhbsrfs.HBSurface]))  # -> out, stlFile; inputs HBObjects: list of GeometryBase
# ---------- python: Python ----------
import scriptcontext as sc
import sys

sys.path.append(r'C:\Users\Administrator\Dropbox\ladybug\Butterfly')
try:
    from butterfly import stl
except:
    raise Exception('add butterfly path to sys.path')


def convertPtsToXYZ(ptList):
    
    xyz = range(len(ptList))
    for count, pt in enumerate(ptList):
        xyz[count] = (pt.X, pt.Y, pt.Z)
    return xyz

def convertVectorToXYZ(vector):
    return (vector.X, vector.Y, vector.Z)

# TODO: Create BFSurface instead of creating dictionaries
def getHBSurfaceNamesVerticesAndNormals(HBSrf):
    verticesList = []
    normals = []
    names = []
    # replace the geometry with the punched geometry
    # for planar surfaces with multiple openings
    if HBSrf.hasChild and HBSrf.punchedGeometry!=None:
        HBSrf.geometry = HBSrf.punchedGeometry
        HBSrf.hasInternalEdge = True
        
    coordinatesList = HBSrf.extractPoints(1, True)
    if isinstance(coordinatesList[0], tuple) or \
       isinstance(coordinatesList[0], list):
        for count, coordinates in enumerate(coordinatesList):
            verticesList.append(convertPtsToXYZ(coordinates))
            normals.append(convertVectorToXYZ(HBSrf.normalVector))
            names.append(HBSrf.name + "_" + str(count))
    else:
        verticesList.append(convertPtsToXYZ(coordinatesList))
        normals.append(convertVectorToXYZ(HBSrf.normalVector))
        names.append(HBSrf.name)
    
    if HBSrf.hasChild:
        glazingData = getHBGlzSurfaceNamesVerticesAndNormals(HBSrf)
        verticesList.extend(glazingData['vertices'])
        normals.extend(glazingData['normals'])
        names.extend(glazingData['names'])
        
    return {'vertices': verticesList, 'normals': normals, 'names': names}

def getHBGlzSurfaceNamesVerticesAndNormals(HBSrf):
    verticesList = []
    normals = []
    names = []
    
    coordinatesList = HBSrf.extractGlzPoints(True)
    if isinstance(coordinatesList[0], list):
        for count, coordinates in enumerate(coordinatesList):
            verticesList.append(convertPtsToXYZ(coordinates))
            normals.append(convertVectorToXYZ(HBSrf.normalVector))
            names.append(HBSrf.childSrfs[count].name + "_" + str(count))
    else:
        verticesList.append(convertPtsToXYZ(coordinatesList))
        normals.append(convertVectorToXYZ(HBSrf.normalVector))
        names.append(HBSrf.childSrfs[0].name)
        
    return {'vertices': verticesList, 'normals': normals, 'names': names}

def getBFSTLMesh(HBObjects):
    if len(HBObjects)==0: return
    HBObjectData = []
    for objCount, HBObj in enumerate(HBObjects):
        # check if the object is zone or a surface
        if HBObj.objectType == "HBZone":            
            if HBObj.hasNonPlanarSrf or HBObj.hasInternalEdge:
                HBObj.prepareNonPlanarZone()
            HBSurfaces = HBObj.surfaces
        else:
            HBSurfaces = [HBObj]
        
        for HBSrf in HBSurfaces:
            HBObjectData.append(getHBSurfaceNamesVerticesAndNormals(HBSrf))
    
    vertices = []
    normals = []
    names = []
    for data in HBObjectData:
        vertices.extend(data['vertices'])
        normals.extend(data['normals'])
        names.extend(data['names'])
    
    # create BFMesh
    pointMesh = stl.BFPointMesh(vertices, normals, names)
    return stl.STLMeshFromPointMesh([pointMesh])
    
    
# load honeybee objects
# call the objects from the lib
hb_hive = sc.sticky["honeybee_Hive"]()
HBObjects = hb_hive.callFromHoneybeeHive(_HBObjects)

# create BFMeshes out of Honeybee objects
BFSTLMesh = getBFSTLMesh(HBObjects)

# generate .stl mesh
BFSTLMesh.writeToFile('c:\ladybug', 'testroom')
# ---------- end python ----------
