# Grasshopper definition genBoxGeometry.gh (Grasshopper 0.9.76)
# plug-ins: Python Interpreter

ladybug = Ladybug_Ladybug()  # -> Vviiiiiiiiiizzz; plug-in component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
honeybee = Honeybee_Honeybee()  # -> Vviiiiiiiiiizzz; plug-in component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
panel = Panel("""    (0 0 0) //0
    (10 0 0) //1
    (10 10 0) //2
    (0 10 0) //3
    (0 4 4) //4
    (10 4 4) //5
    (10 6 4) //6
    (0 6 4) //7
    (0 4 6) //8
    (10 4 6) //9
    (10 6 6) //10
    (0 6 6) //11
    (0 0 10) //12
    (10 0 10) //13
    (10 10 10) //14
    (0 10 10) //15""")
brep = Brep(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)
mass2zone = Honeybee_Masses2Zones(zoneMasses=flatten(brep), isConditioned=True, maxRoofAngle=30, createHBZones=Toggle(True))  # -> readMe, HBZones; plug-in component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
split = TextSplit(Text=panel, Separators="//")
item = ListItem(List=split, Index=0, Wrap=True)
python = PythonScript(HBObj=mass2zone.HBZones)  # -> out, a; inputs HBObj: Brep
# ---------- python: Python ----------
"""
iterate all surfaces and generate a dictonary
{
vertices : [],
faces:
    { inlet : {},
      oulet: {},
      wall: {
        name : {
            vertices : [list of vertices]
        },
        ...
      }
    }
}
"""
# ---------- end python ----------
rep = ReplaceText(Text=item, Find="(", RecursiveReplace=False)
runenergysimulation = Honeybee_RunEnergySimulation()  # -> report, idfFileAddress, resultFileAddress; plug-in component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
rep_2 = ReplaceText(Text=rep, Find=")", RecursiveReplace=False)
split_2 = TextSplit(Text=rep_2, Separators=" ")
item_2 = ListItem(List=split_2, Index="4", Wrap=True)  # -> Item, Item1, Item2
pt = ConstructPoint(XCoordinate=item_2.Item, YCoordinate=item_2.Item1, ZCoordinate=item_2.Item2)  # -> flatten(Point)
split_3 = TextSplit(Text="0 1 5 4 12 13 9 8", Separators=" ")
panel_2 = Panel(pt)
item_3 = ListItem(List=pt, Index=split_3, Wrap=True)
pline = PolyLine(Vertices=item_3, Closed=False)
