# Dynamo custom node Create Case from Geometries.dyf (Dynamo 1.2.0.2690)
# category: Butterfly.00::Create
# Create an OpenFOAM Case from geometries. -

input_python_script = CodeBlock { "Butterfly"; "casefromgeos_node.py"; }
import_and_prepare_py_code = Python(IN[0]=input_python_script.out0, IN[1]=input_python_script.out1)
# ---------- import_and_prepare_py_code.python (80 lines) ----------
        
"""Find packages from Dynamo folder and prepare the code."""
import clr
from System import AppDomain, Environment, IO

def tryGetPluginPath(plugin):
    """Try to get path to plugin folder."""
    clr.AddReference('ProtoGeometry')
    _loc = tuple(a.Location
                 for a in AppDomain.CurrentDomain.GetAssemblies()
                 if 'ProtoGeometry' in a.FullName)

    try:
        _ver = float(_loc[0].split('\\')[-2])
    except:
        _ver = float(_loc[0].split('\\')[-2].split(' ')[-1])

    assert _ver >= 1.2, 'You need Dynamo 1.2 or higher to use this plugin!'

    _appdata = Environment.GetFolderPath(Environment.SpecialFolder.ApplicationData)
    _dynamoPath = ('\\').join(_loc[0].split('\\')[-4:-1])
    # if the assembly is cached put Revit folder first, and then try to load it from core
    _dynamoPaths = (_dynamoPath.replace('Dynamo Core', 'Dynamo Revit'),
                    _dynamoPath.replace('Dynamo Revit', 'Dynamo Core'))
    _settingsFilename = 'DynamoSettings.xml'

    pkf = []
    for path in _dynamoPaths:
        settingsFile = IO.Path.Combine(_appdata, path, _settingsFilename)
        if IO.File.Exists(settingsFile):
            with open(settingsFile, 'rb') as outf:
                for line in outf:
                    if line.strip().startswith('<CustomPackageFolders>'):
                        for l in outf:
                            if l.strip().startswith('</CustomPackageFolders>'):
                                break
                            else:
                                pkf.append(l.replace('</string>', '').replace('<string>', '').strip())

    for p in pkf:
        pp = IO.Path.Combine(p, 'packages', plugin, 'extra')
        if IO.Directory.Exists(pp):
            return pp

try:
    plugin, filename = IN
    p = tryGetPluginPath(plugin)
    if not p:
        raise ImportError('{} is not installed! Install it from package manager.'.format(plugin))
    # import the file and wrap it into sys.append
    f = IO.Path.Combine(p, 'nodesrc', filename)
    with open(f, 'rb') as inf:
        source = '    '.join(inf.readlines())

    header = 'try:\n    import sys\n' + \
        '    sys.path.append(r\'{}\')\n\n'.format(p) + \
        '    sys.path.append(r\'C:\Program Files (x86)\IronPython 2.7\Lib\')\n\n' + \
        '    '

    footer = '\nexcept Exception, e:\n' + \
        '    import traceback\n' + \
        '    OUT = "ERROR:\\n\\t{}".format(str(e)) + \\\n' + \
        '    "\\n\\nIf you think this is a bug submit an issue on github.\\n" + \\\n' + \
        '    "https://github.com/ladybug-analysis-tools/honeybee-plus/issues\\n" +  \\\n' + \
        '    "and include below error message:\\n\\n" + \\\n' + \
        '    "{}".format(traceback.format_exc())\n'

    OUT = header + source + footer

except Exception, e:
    import sys
    sys.path.append(r'C:\Program Files (x86)\IronPython 2.7\Lib')
    import traceback
    OUT = "ERROR:\n\t{}".format(str(e)) + \
        "\n\nIf you think this is a bug submit an issue on github.\n" + \
        "https://github.com/ladybug-analysis-tools/honeybee-plus/issues\n" +  \
        "and include below error message:\n\n" + \
        "{}".format(traceback.format_exc())

      
# ----------------------------------------
name = Input(_name: string)  # Project name.
BFGeometries = Input(_BFGeometries: System.Object[])  # List of butterfly geometries for this case.
refRegions = Input(refRegions_: System.Object[] = {})  # A list of refinement regions.
make2dParams = Input(make2dParams_: System.Object = null)  # Butterfly parameters to make a 2d wind tunnel.
meshParams = Input(_meshParams_: System.Object = null)  # Butterfly meshing parameters. You can set-up meshing parameters also on the blockMesh and snappyHexMesh components to overwrite this settings. Use this input to set up the meshing parameters if you are not running the meshing locally.
expandBlockMesh = Input(expandBlockMesh_: bool = true)  # Butterfly by default expands the mesh by one cell to ensure snappyHexMesh will snap to extrior surfaces. You can set the expand to off or overwrite the vertices using update blockMeshDict component.
run = Input(_run: bool)  # Create case from inputs.
core = PythonStringNode(script=import_and_prepare_py_code, IN[0]=name, IN[1]=BFGeometries, IN[2]=refRegions, IN[3]=make2dParams, IN[4]=meshParams, IN[5]=expandBlockMesh, IN[6]=run)
decompose_outputs = CodeBlock(out=core) { out[0]; out[1]; }
blockPts = Output(decompose_outputs.out0)  # Script variable caseFromGeos
case = Output(decompose_outputs.out1)  # Butterfly case.
error_report = Python(IN[0]=import_and_prepare_py_code, IN[1]=core)
# ---------- error_report.python (17 lines) ----------
        
"""Report errors"""
importErr, runErr = IN
errors = []

if importErr and str(importErr).startswith("ERROR:"):
    errors.append(importErr)

if runErr and str(runErr).startswith("ERROR:"):
    errors.append(runErr)

if len(errors)==0:
    OUT = "All good! Vvizzzz."
else:
    OUT = "\n".join(errors)

      
# ----------------------------------------
ERRReport = Output(error_report)  # Report
