# Dynamo custom node Create Case from Tunnel.dyf (Dynamo 1.2.0.2690)
# category: Butterfly.00::Create
# Create Case from wind tunnel. -

input_python_script = CodeBlock { "Butterfly"; "createcasefromtunnel_node.py"; }
import_and_prepare_py_code = Python(IN[0]=input_python_script.out0, IN[1]=input_python_script.out1)
# ---------- import_and_prepare_py_code.python (80 lines) ----------
        
"""Find packages from Dynamo folder and prepare the code."""
import clr
from System import AppDomain, Environment, IO

def tryGetPluginPath(plugin):
    """Try to get path to plugin folder."""
    clr.AddReference('ProtoGeometry')
    _loc = tuple(a.Location
                 for a in AppDomain.CurrentDomain.GetAssemblies()
                 if 'ProtoGeometry' in a.FullName)

    try:
        _ver = float(_loc[0].split('\\')[-2])
    except:
        _ver = float(_loc[0].split('\\')[-2].split(' ')[-1])

    assert _ver >= 1.2, 'You need Dynamo 1.2 or higher to use this plugin!'

    _appdata = Environment.GetFolderPath(Environment.SpecialFolder.ApplicationData)
    _dynamoPath = ('\\').join(_loc[0].split('\\')[-4:-1])
    # if the assembly is cached put Revit folder first, and then try to load it from core
    _dynamoPaths = (_dynamoPath.replace('Dynamo Core', 'Dynamo Revit'),
                    _dynamoPath.replace('Dynamo Revit', 'Dynamo Core'))
    _settingsFilename = 'DynamoSettings.xml'

    pkf = []
    for path in _dynamoPaths:
        settingsFile = IO.Path.Combine(_appdata, path, _settingsFilename)
        if IO.File.Exists(settingsFile):
            with open(settingsFile, 'rb') as outf:
                for line in outf:
                    if line.strip().startswith('<CustomPackageFolders>'):
                        for l in outf:
                            if l.strip().startswith('</CustomPackageFolders>'):
                                break
                            else:
                                pkf.append(l.replace('</string>', '').replace('<string>', '').strip())

    for p in pkf:
        pp = IO.Path.Combine(p, 'packages', plugin, 'extra')
        if IO.Directory.Exists(pp):
            return pp

try:
    plugin, filename = IN
    p = tryGetPluginPath(plugin)
    if not p:
        raise ImportError('{} is not installed! Install it from package manager.'.format(plugin))
    # import the file and wrap it into sys.append
    f = IO.Path.Combine(p, 'nodesrc', filename)
    with open(f, 'rb') as inf:
        source = '    '.join(inf.readlines())

    header = 'try:\n    import sys\n' + \
        '    sys.path.append(r\'{}\')\n\n'.format(p) + \
        '    sys.path.append(r\'C:\Program Files (x86)\IronPython 2.7\Lib\')\n\n' + \
        '    '

    footer = '\nexcept Exception, e:\n' + \
        '    import traceback\n' + \
        '    OUT = "ERROR:\\n\\t{}".format(str(e)) + \\\n' + \
        '    "\\n\\nIf you think this is a bug submit an issue on github.\\n" + \\\n' + \
        '    "https://github.com/ladybug-analysis-tools/butterfly/issues\\n" +  \\\n' + \
        '    "and include below error message:\\n\\n" + \\\n' + \
        '    "{}".format(traceback.format_exc())\n'

    OUT = header + source + footer

except Exception, e:
    import sys
    sys.path.append(r'C:\Program Files (x86)\IronPython 2.7\Lib')
    import traceback
    OUT = "ERROR:\n\t{}".format(str(e)) + \
        "\n\nIf you think this is a bug submit an issue on github.\n" + \
        "https://github.com/ladybug-analysis-tools/butterfly/issues\n" +  \
        "and include below error message:\n\n" + \
        "{}".format(traceback.format_exc())

      
# ----------------------------------------
name = Input(_name: string)  # Project name.
BFGeometries = Input(_BFGeometries: System.Object[])  # List of butterfly geometries that will be inside the tunnel.
refRegions = Input(refRegions_: System.Object[] = {})  # Script variable createCaseFromTunnel
windVector = Input(_windVector: Autodesk.Vector)  # A vector that indicates speed and direction of wind. Length of the vector will be used as windspeed and the unfied vector will be used for wind direction. For wind tunnel vector will be projected to XY plane.
refWindHeight = Input(_refWindHeight_: double = 10)  # Reference height for wind velocity (default: 10m).
landscape = Input(_landscape_: int = 6)  # An integer between 0-7 to calculate z0 (roughness). You can find full description of the landscape in Table I at this link (onlinelibrary.wiley.com/doi/10.1002/met.273/pdf) 0 > '0.0002'  # sea. Open sea or lake (irrespective of wave size), tidal flat, snow-covered flat plain, featureless desert, tarmac and concrete, with a free fetch of several kilometres 1 > '0.005'   # smooth. Featureless land surface without any noticeable obstacles and with negligible vegetation; e.g. beaches, pack ice without large ridges, marsh and snow-covered or fallow open country. 2 > '0.03'    # open. Level country with low vegetation (e.g. grass) and isolated obstacles with separations of at least 50 obstacle heights; e.g. grazing land without wind breaks, heather, moor and tundra, runway area of airports. Ice with ridges across-wind. 3 > '0.10'    # roughly open. Cultivated or natural area with low crops or plant covers, or moderately open country with occasional obstacles (e.g. low hedges, isolated low buildings or trees) at relative horizontal distances of at least 20 obstacle heights 4 > '0.25'    # rough. Cultivated or natural area with high crops or crops of varying height, and scattered obstacles at relative distances of 12-15 obstacle heights for porous objects (e.g. shelterbelts) or 8-12 obstacle heights for low solid objects (e.g. buildings). 5 > '0.5'     # very rough. Intensively cultivated landscape with many rather large obstacle groups (large farms, clumps of forest) separated by open spaces of about eight obstacle heights. Low densely planted major vegetation like bush land, orchards, young forest. Also, area moderately covered by low buildings with interspaces of three to seven building heights and no high trees. 6 > '1.0'     # Skimming. Landscape regularly covered with similar-size large obstacles, with open spaces of the same order of magnitude as obstacle heights; e.g. mature regular forests, densely built-up area without much building height variation. 7 > '2.0'     # chaotic. City centres with mixture of low-rise and high-rise buildings, or large forests of irregular height with many clearings.
make2dParams = Input(make2dParams_: System.Object = null)  # Butterfly parameters to make a 2d wind tunnel.
meshParams = Input(_meshParams_: System.Object = null)  # Butterfly meshing parameters. You can set-up meshing parameters also on the blockMesh and snappyHexMesh components to overwrite this settings. Use this input to set up the meshing parameters if you are not running the meshing locally.
tunnelParams = Input(_tunnelParams_: System.Object = null)  # Butterfly tunnel parameters.
run = Input(_run: bool)  # Create wind tunnel case from inputs.
core = PythonStringNode(script=import_and_prepare_py_code, IN[0]=name, IN[1]=BFGeometries, IN[2]=refRegions, IN[3]=windVector, IN[4]=refWindHeight, IN[5]=landscape, IN[6]=make2dParams, IN[7]=meshParams, IN[8]=tunnelParams, IN[9]=run)
decompose_outputs = CodeBlock(out=core) { out[0]; out[1]; }
pts = Output(decompose_outputs.out0)  # Wind tunnel corners for visualization.
case = Output(decompose_outputs.out1)  # Butterfly case.
error_report = Python(IN[0]=import_and_prepare_py_code, IN[1]=core)
# ---------- error_report.python (17 lines) ----------
        
"""Report errors"""
importErr, runErr = IN
errors = []

if importErr and str(importErr).startswith("ERROR:"):
    errors.append(importErr)

if runErr and str(runErr).startswith("ERROR:"):
    errors.append(runErr)

if len(errors)==0:
    OUT = "All good! Vvizzzz."
else:
    OUT = "\n".join(errors)

      
# ----------------------------------------
ERRReport = Output(error_report)  # Report
