# Dynamo custom node Visualize Vectors.dyf (Dynamo 1.2.1.3083)
# category: Butterfly.07::PostProcess
# Visualize vectors

vectors = Input(_vectors: Autodesk.Vector[])  # list of vectors
length = Vector.Length(vectors)
scale = Input(scale_: double = 0.25)  # scale vector size
code_block = CodeBlock(value=length, scale=scale) { value * scale; }
code_block_2 = CodeBlock(length=code_block) { length != 0; }
filterByBoolMask = List.FilterByBoolMask(list=code_block, mask=code_block_2)
legendPar = Input(_legendPar_: var = null)  # legend parameters. Find it under ladybug extras
generate_colors = Custom[Generate Colors](values=filterByBoolMask.in, legendPar=legendPar)  # Color a test surface based on the results of a study. The results structure should match the test points structure to be mapped correctly on the surface.
ERRReport = Output(generate_colors.ERRReport)
startPts = Input(_startPts: Autodesk.Point[])  # list of start points
filterByBoolMask_2 = List.FilterByBoolMask(list=startPts, mask=code_block_2)
filterByBoolMask_3 = List.FilterByBoolMask(list=vectors, mask=code_block_2)
byStartPointDirectionLength = Line.ByStartPointDirectionLength(startPoint=filterByBoolMask_2.in, direction=filterByBoolMask_3.in, length=filterByBoolMask.in)
scaleHead = Input(scaleHead_: double = 1.0)  # scale arrow heade
code_block_3 = CodeBlock(length=filterByBoolMask.in, scale=scaleHead) { length * 0.25 * scale; }

# group: create arrow
code_block_4 = CodeBlock { 0.75; }
pointAtParameter = Curve.PointAtParameter(curve=byStartPointDirectionLength, param=code_block_4)
endPoint = Curve.EndPoint(byStartPointDirectionLength)
byPointsRadius = Cone.ByPointsRadius(pointAtParameter, endPoint, code_block_3)

create = List.Create(byStartPointDirectionLength, byPointsRadius)
create_2 = List.Create(generate_colors.colors, generate_colors.colors)
byGeometryColor = Display.Display.ByGeometryColor(create, create_2)
Display = Output(byGeometryColor)
