# Dynamo graph create_case_from_folder.dyn (Dynamo 1.2.1.3083)

code_block = CodeBlock { "C:\\Users\\Mostapha\\butterfly\\indoor_airflow"; }
boolean = BoolSelector(true)
create_case_from_folder = Custom[Create Case from Folder](folder=code_block, run=boolean)  # Create an OpenFOAM Case from an existing case in a local folder. -
boolean_2 = BoolSelector(false)
blockMesh = Custom[blockMesh](case=create_case_from_folder.case, run=boolean_2)  # blockMesh -
boolean_3 = BoolSelector(false)
snappyHexMesh = Custom[snappyHexMesh](case=blockMesh.case, run=boolean_3)  # snappyHexMesh -
boolean_4 = BoolSelector(false)
load_mesh = Custom[Load Mesh](case=snappyHexMesh.case, load=boolean_4)  # Load mesh from the case for preview. -
edges = Autodesk.Dynamo.MeshToolkit.Mesh.Edges(load_mesh.mesh)
get_geometry = Custom[Get Geometry](BFObjects=create_case_from_folder.case)  # Update fvSchemes values based on mesh orthogonalities. -
edges_2 = Autodesk.Dynamo.MeshToolkit.Mesh.Edges(get_geometry.geometries)
