# Dynamo graph indoor_study.dyn (Dynamo 1.2.1.3083)

code_block = CodeBlock { "indoor_study"; }
code_block_2 = CodeBlock { "wall_floor_roof"; }
boolean = BoolSelector(true)
collect_rooms_and_spaces = Custom[Collect Rooms and Spaces](collect=boolean)  # Collect rooms and MEP spaces in the Revit document. Use "Rooms to HBZones" node to convert them to Honeybee zones.
code_block_3 = CodeBlock(rooms=collect_rooms_and_spaces.rooms) { rooms[1]; }

# group: This is a honeybee node. In the next few release this node will output polygons in a more structured way!
rooms_to_hbzones = Custom[Rooms to HBZones](rooms=code_block_3)  # Create Honeybee zones from Revit Rooms or MEPSpaces. This node currently ONLY collects geometrical data from Revit. In the future it will import constructions, materials and MEP data (e.g lighting power density).

code_block_4 = CodeBlock(x=rooms_to_hbzones.polylines) { polylines = x[0]; }

# group: roof, floor and walls with no window!
code_block_5 = CodeBlock(x=code_block_4) { {x[0..1], x[7]}; }
flatten = Flatten(code_block_5)
byPatch = Surface.ByPatch(flatten)

code_block_6 = CodeBlock(x=code_block_4) { x[2]; x[3]; }
byPatch_2 = Surface.ByPatch(code_block_6.out0)
byPatch_3 = Surface.ByPatch(code_block_6.out1)
center = Polygon.Center(code_block_6.out1)
trim = Geometry.Trim(geometry=byPatch_2, other=byPatch_3, pick=center)
flatten_2 = Flatten(trim)
intersectAll = Geometry.IntersectAll(geometry=byPatch_2, others=flatten_2)
code_block_7 = CodeBlock(x=code_block_4) { x[4]; x[5..6]; }
byPatch_4 = Surface.ByPatch(code_block_7.out0)
byPatch_5 = Surface.ByPatch(code_block_7.out1)
center_2 = Polygon.Center(code_block_7.out1)
trim_2 = Geometry.Trim(geometry=byPatch_4, other=byPatch_5, pick=center_2)
flatten_3 = Flatten(trim_2)
intersectAll_2 = Geometry.IntersectAll(geometry=byPatch_4, others=flatten_3)
code_block_8 = CodeBlock(x=code_block_4) { x[8]; x[9]; }
byPatch_6 = Surface.ByPatch(code_block_8.out0)
byPatch_7 = Surface.ByPatch(code_block_8.out1)
center_3 = Polygon.Center(code_block_8.out1)
trim_3 = Geometry.Trim(geometry=byPatch_6, other=byPatch_7, pick=center_3)
flatten_4 = Flatten(trim_3)
intersectAll_3 = Geometry.IntersectAll(geometry=byPatch_6, others=flatten_4)

# group: Walls!
create = List.Create(byPatch, intersectAll, intersectAll_2, intersectAll_3)

flatten_5 = Flatten(create)
byJoinedSurfaces = PolySurface.ByJoinedSurfaces(flatten_5)
create_butterfly_geometry = Custom[Create Butterfly Geometry](name=code_block_2, geo=byJoinedSurfaces)  # Create Butterfly surface. -
code_block_9 = CodeBlock { "oulet_windows"; }

# group: Outlet windows
create_2 = List.Create(byPatch_5, byPatch_3)

flatten_6 = Flatten(create_2)
byJoinedSurfaces_2 = PolySurface.ByJoinedSurfaces(flatten_6)
outlet_boundary = Custom[Outlet Boundary]()  # Create an outlet boundary with uniform pressure value. -
code_block_10 = CodeBlock { {2, 2}; }
create_butterfly_geometry_2 = Custom[Create Butterfly Geometry](name=code_block_9, geo=byJoinedSurfaces_2, boundary=outlet_boundary.outletBoundary, refineLevels=code_block_10)
code_block_11 = CodeBlock { "inlet_windows"; }

# group: Inlet Windows
byJoinedSurfaces_3 = PolySurface.ByJoinedSurfaces(byPatch_7)

code_block_12 = CodeBlock { 2.4; }
byCoordinates = Vector.ByCoordinates(x=code_block_12)
inlet_boundary = Custom[Inlet Boundary](velocityVec=byCoordinates)  # Create an inlet boundary with uniform velocity value. -
create_butterfly_geometry_3 = Custom[Create Butterfly Geometry](name=code_block_11, geo=byJoinedSurfaces_3, boundary=inlet_boundary.inletBoundary, refineLevels=code_block_10)
create_3 = List.Create(create_butterfly_geometry.BFGeometries, create_butterfly_geometry_2.BFGeometries, create_butterfly_geometry_3.BFGeometries)
flatten_7 = Flatten(create_3)

# group: Make sure these values are valid in your document units!
cell_size_in_x_y_z_direction = CodeBlock { x = 200; y = 200; z = 200; }

byCoordinates_2 = Point.ByCoordinates(x=cell_size_in_x_y_z_direction.x, y=cell_size_in_x_y_z_direction.y, z=cell_size_in_x_y_z_direction.z)
meshing_parameters = Custom[Meshing Parameters](cellSizeXYZ=byCoordinates_2)  # Set meshing parameters for blockMesh and snappyHexMesh.

# group: 1. set to true to create the OpenFOAM case for this room.
boolean_2 = BoolSelector(false)

create_case_from_geometries = Custom[Create Case from Geometries](name=code_block, BFGeometries=flatten_7, meshParams=meshing_parameters.meshParams, run=boolean_2)  # Create an OpenFOAM Case from geometries. -

# group: 2. set to Ture to run blockMesh.
boolean_3 = BoolSelector(false)

blockMesh = Custom[blockMesh](case=create_case_from_geometries.case, run=boolean_3)  # blockMesh -
boolean_4 = BoolSelector(false)
code_block_13 = CodeBlock { "castellatedMeshControls  {resolveFeatureAngle 95; }"; }
snappyHexMeshDict = Custom[snappyHexMeshDict](snap=boolean_4, additionalParameters=code_block_13)  # Set parameters for snappyHexMeshDict. Read more about snappyHexMeshDict here: https://openfoamwiki.net/images/f/f0/Final-AndrewJacksonSlidesOFW7.pdf

# group: 3. set to Ture to run snappyHexMesh
boolean_5 = BoolSelector(false)

snappyHexMesh = Custom[snappyHexMesh](case=blockMesh.case, snappyHexMeshDict=snappyHexMeshDict.snappyHexMeshDict, run=boolean_5)  # snappyHexMesh -

# group: 4. load the mesh and check mesh quality.
boolean_6 = BoolSelector(false)

load_mesh = Custom[Load Mesh](case=snappyHexMesh.case, load=boolean_6)  # Load mesh from the case for preview. -
watch = Watch(load_mesh.ERRReport)
steady_incompressible_recipe = Custom[Steady Incompressible Recipe]()  # Steady Incompressible Recipe. -
code_block_14 = CodeBlock { 1000; }
controlDict = Custom[controlDict](endTime=code_block_14)  # Set parameters for runDict
solution_parameters = Custom[Solution Parameters](controlDict=controlDict.controlDict)  # Solution Parameters.

# group: 5. write the solution. This node adds solution files based on the recipe.
boolean_7 = BoolSelector(false)

# group: 6. Once you set run to True it starts iterations to solve the case.
boolean_8 = BoolSelector(false)

solution = Custom[Solution](case=snappyHexMesh.case, recipe=steady_incompressible_recipe.recipe, solutionParams=solution_parameters.solutionParams, write=boolean_7, run=boolean_8)  # Run recipes using OpenFOAM. -
watch_2 = Watch(solution.residualValues)
watch_3 = Watch(solution.residualFields)
code_block_15 = CodeBlock { "peds"; "U"; }
code_block_16 = CodeBlock(x=byPatch) { x[1]; }

# group: Create a number of points to sample the wind tunnel and get the results.
code_block_17 = CodeBlock { 0..1..#50; 0..1..#40; 900; }
pointAtParameter = Surface.PointAtParameter(surface=code_block_16, u=code_block_17.out0, v=code_block_17.out1, lacing=CrossProduct)
byCoordinates_3 = Vector.ByCoordinates(z=code_block_17.out2)
translate = Geometry.Translate(geometry=pointAtParameter, direction=byCoordinates_3, lacing=CrossProduct)
flatten_8 = Flatten(translate)

# group: 7. Set to True to visualize velocity vectors.
boolean_9 = BoolSelector(false)

sample_case = Custom[Sample Case](solution=solution.solution, name=code_block_15.out0, points=flatten_8, field=code_block_15.out1, run=boolean_9)  # Sample the results for a case. Use this component yo load the results for a case that you have ran already. -
code_block_18 = CodeBlock { 150; 0.5; }
code_block_19 = CodeBlock { 17; }
lb_color_range = Custom[LB Color Range](index=code_block_19)  # A set of color ranges for coloring analysis results
legend_parameters = Custom[Legend Parameters](colors=lb_color_range.colors)  # Use legend parameter to set up results visualization setting
visualize_vectors = Custom[Visualize Vectors](vectors=sample_case.values, startPts=sample_case.probes, scale=code_block_18.out0, scaleHead=code_block_18.out1, legendPar=legend_parameters.legendPar)  # Visualize vectors
boolean_10 = BoolSelector(false)
purgeCase = Custom[purgeCase](case=create_case_from_geometries.case, results=boolean_10, postProcessing=boolean_10)  # Purge case folder. -
error_messages_if_any_if_you = Watch(create_case_from_geometries.ERRReport)  # "Error messages if any! If you haven't run Revit as an admin you should get an error about it!"
error_messages_if_any_if_your = Watch(blockMesh.ERRReport)  # "Error messages if any! If your OpenFOAM installation is not working correctly or the VM is not running here it will give you an error."
watch_4 = Watch(solution.ERRReport)
watch_5 = Watch(solution.timestep)
error_messages_if_any_if_you_2 = Watch(create_case_from_geometries.case)  # "Error messages if any! If you haven't run Revit as an admin you should get an error about it!"
watch_6 = Watch(sample_case.ERRReport)
