# Dynamo graph outdoor_study.dyn (Dynamo 1.2.1.3083)

code_block = CodeBlock { "outdoor_study"; }
code_block_2 = CodeBlock { "building"; }

# group: Make sure these values are valid in your document units!
block_size_in_document_units = CodeBlock { x = 10; y = 20; z = 20; z / 2; }

byCoordinates = Point.ByCoordinates(z=block_size_in_document_units.out3)
byLengths = Cuboid.ByLengths(origin=byCoordinates, width=block_size_in_document_units.x, length=block_size_in_document_units.x, height=block_size_in_document_units.z)
refinement_levels = CodeBlock { {2, 2}; }
# note: convert Dynamo/Revit geometry to Butterfly Geometry
create_butterfly_geometry = Custom[Create Butterfly Geometry](name=code_block_2, geo=byLengths, refineLevels=refinement_levels)  # Create Butterfly surface. -
code_block_3 = CodeBlock { 5; }
wind_vector = Custom[Wind Vector](windSpeed=code_block_3)  # Wind vector. -
wind_tunnel_parameters = Custom[Wind Tunnel Parameters]()  # Wind tunnel parameters. -

# group: 1. set to true to create the wind tunnel
boolean = BoolSelector(false)

# note: create wind tunnel
create_case_from_tunnel = Custom[Create Case from Tunnel](name=code_block, BFGeometries=create_butterfly_geometry.BFGeometries, windVector=wind_vector.windVector, tunnelParams=wind_tunnel_parameters.tunnelParams, run=boolean)  # Create Case from wind tunnel. -

# group: Make sure these values are valid in your document units!
code_block_4 = CodeBlock { 10; 10; 10; }

byCoordinates_2 = Point.ByCoordinates(x=code_block_4.out0, y=code_block_4.out1, z=code_block_4.out2)

# group: 2. set to Ture to run blockMesh.
boolean_2 = BoolSelector(false)

blockMesh = Custom[blockMesh](case=create_case_from_tunnel.case, cellSizeXYZ=byCoordinates_2, run=boolean_2)  # blockMesh -
boolean_3 = BoolSelector(false)
code_block_5 = CodeBlock { "castellatedMeshControls  {resolveFeatureAngle 95; }"; }
snappyHexMeshDict = Custom[snappyHexMeshDict](snap=boolean_3, additionalParameters=code_block_5)  # Set parameters for snappyHexMeshDict. Read more about snappyHexMeshDict here: https://openfoamwiki.net/images/f/f0/Final-AndrewJacksonSlidesOFW7.pdf

# group: 3. set to Ture to run snappyHexMesh
boolean_4 = BoolSelector(false)

snappyHexMesh = Custom[snappyHexMesh](case=blockMesh.case, snappyHexMeshDict=snappyHexMeshDict.snappyHexMeshDict, run=boolean_4)  # snappyHexMesh -

# group: 4. load the mesh and check mesh quality.
boolean_5 = BoolSelector(false)

load_mesh = Custom[Load Mesh](case=snappyHexMesh.case, load=boolean_5)  # Load mesh from the case for preview. -
watch = Watch(load_mesh.ERRReport)
steady_incompressible_recipe = Custom[Steady Incompressible Recipe]()  # Steady Incompressible Recipe. -
code_block_6 = CodeBlock { 200; }
controlDict = Custom[controlDict](endTime=code_block_6)  # Set parameters for runDict
string_from_object = FromObject(controlDict.controlDict)
solution_parameters = Custom[Solution Parameters](controlDict=string_from_object)  # Solution Parameters.

# group: 5. write the solution. This node adds solution files based on the recipe.
boolean_6 = BoolSelector(false)

# group: 6. Once you set run to True it starts iterations to solve the case.
boolean_7 = BoolSelector(false)

solution = Custom[Solution](case=snappyHexMesh.case, recipe=steady_incompressible_recipe.recipe, solutionParams=solution_parameters.solutionParams, write=boolean_6, run=boolean_7)  # Run recipes using OpenFOAM. -
watch_2 = Watch(solution.residualValues)
watch_3 = Watch(solution.residualFields)
code_block_7 = CodeBlock { "peds"; "U"; }

# group: Create a number of points to sample the wind tunnel and get the results.
code_block_8 = CodeBlock(x=create_case_from_tunnel.pts) { x[0..3]; true; }
byPoints = PolyCurve.ByPoints(points=code_block_8.out0, connectLastToFirst=code_block_8.out1)
code_block_9 = CodeBlock { 0.5; }
scale = Geometry.Scale(geometry=byPoints, amount=code_block_9)
byPatch = Surface.ByPatch(scale)
code_block_10 = CodeBlock { 0..1..#20; 0..1..#50; 2; }
pointAtParameter = Surface.PointAtParameter(surface=byPatch, u=code_block_10.out0, v=code_block_10.out1, lacing=CrossProduct)
byCoordinates_3 = Vector.ByCoordinates(z=code_block_10.out2)
translate = Geometry.Translate(geometry=pointAtParameter, direction=byCoordinates_3)
code_block_11 = CodeBlock { {0.045, 0.5 + 0.045}; }
pointAtParameter_2 = Curve.PointAtParameter(curve=scale, param=code_block_11)
byBestFitThroughPoints = Line.ByBestFitThroughPoints(pointAtParameter_2)
code_block_12 = CodeBlock { 30; }
byCoordinates_4 = Vector.ByCoordinates(z=code_block_12)
extrude = Curve.Extrude(byBestFitThroughPoints, byCoordinates_4)
code_block_13 = CodeBlock { 0..1..#20; 0..1..#60; }
pointAtParameter_3 = Surface.PointAtParameter(surface=extrude, u=code_block_13.out1, v=code_block_13.out0, lacing=CrossProduct)
create = List.Create(translate, pointAtParameter_3)
flatten = Flatten(create)

# group: 7. Set to True to visualize velocity vectors.
boolean_8 = BoolSelector(false)

sample_case = Custom[Sample Case](solution=solution.solution, name=code_block_7.out0, points=flatten, field=code_block_7.out1, run=boolean_8)  # Sample the results for a case. Use this component yo load the results for a case that you have ran already. -
code_block_14 = CodeBlock { 1.25; 0.5; }
code_block_15 = CodeBlock { 17; }
lb_color_range = Custom[LB Color Range](index=code_block_15)  # A set of color ranges for coloring analysis results
legend_parameters = Custom[Legend Parameters](colors=lb_color_range.colors)  # Use legend parameter to set up results visualization setting
visualize_vectors = Custom[Visualize Vectors](vectors=sample_case.values, startPts=sample_case.probes, scale=code_block_14.out0, scaleHead=code_block_14.out1, legendPar=legend_parameters.legendPar)  # Visualize vectors
boolean_9 = BoolSelector(false)
purgeCase = Custom[purgeCase](case=create_case_from_tunnel.case, results=boolean_9, postProcessing=boolean_9)  # Purge case folder. -
error_messages_if_any_if_you = Watch(create_case_from_tunnel.ERRReport)  # "Error messages if any! If you haven't run Revit as an admin you should get an error about it!"
error_messages_if_any_if_your = Watch(blockMesh.ERRReport)  # "Error messages if any! If your OpenFOAM installation is not working correctly or the VM is not running here it will give you an error."
watch_4 = Watch(solution.ERRReport)
