# Dynamo graph visualize_vectors.dyn (Dynamo 1.2.1.3083)

code_block = CodeBlock { "C:\\Users\\Mostapha\\butterfly\\indoor_airflow"; "U"; }
load_probes_value = Custom[Load Probes Value](solution=code_block.out0, field=code_block.out1)  # Load results for a field in probes. -
load_probes = Custom[Load Probes](solution=code_block.out0, field=code_block.out1)  # Load probes from a folder. -
number_slider = DoubleSlider(0.25, range=0.1..1 step 0.01)
code_block_2 = CodeBlock { 17; }
lb_color_range = Custom[LB Color Range](index=code_block_2)  # A set of color ranges for coloring analysis results
legend_parameters = Custom[Legend Parameters](colors=lb_color_range.colors)  # Use legend parameter to set up results visualization setting
visualize_vectors = Custom[Visualize Vectors](vectors=load_probes_value.values, startPts=load_probes.probes, scale=number_slider, legendPar=legend_parameters.legendPar)  # Visualize vectors
