# Grasshopper definition indoor_airflow_2d.gh (Grasshopper 0.9.76)
# plug-ins: Python Interpreter

epsilonwallfunction = Butterfly_epsilonWallFunction(Cmu=0.09, kappa=0.4, E=9.8)  # -> epsilonWallFunction; plug-in component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
nutkwallfunction = Butterfly_nutkWallFunction()  # -> nutkWallFunction; plug-in component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
kqrwallfunction = Butterfly_kqRWallFunction(value="0.01")  # -> kqRWallFunction; plug-in component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
fixedvalue = Butterfly_fixedValue(value="(0 0 0)")  # -> fixedValue; plug-in component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
zerogradient = Butterfly_zeroGradient()  # -> zeroGradient; plug-in component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
calculated = Butterfly_calculated()  # -> calculated; plug-in component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

# ----
# Create your own boundary
# from boundary conditions
panel = Panel("patch")
panel_2 = Panel(nutkwallfunction)

# ---- group: create your own
boundary = Butterfly_Boundary(bType=panel, U=zerogradient, p=zerogradient, k=zerogradient, epsilon=calculated, nut=calculated)  # -> readMe, boundary; plug-in component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

# ---- group: we don't want snappyHexMesh to subdivide the mesh anymore
panel_3 = Panel("(0, 0)")

# ----
vec = VectorXYZ(XComponent="2", YComponent=0, ZComponent=0)  # -> Vector, Length
outlet = Butterfly_OutletBoundary(refLevels=panel_3)  # -> outletBoundary; plug-in component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
# 0. CREATE BUTTERFLY SURFACES
inlet = Butterfly_InletBoundary(velocityVec=vec.Vector, refLevels=panel_3)  # -> inletBoundary; plug-in component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
wall = Butterfly_WallBoundary(refLevels=panel_3)  # -> wallBoundary; plug-in component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

# ---- group: inlet!
srf = Surface(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)

# ---- group: walls
brep = Brep(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)

# ---- group: outlet
srf_2 = Surface([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])

# ----
wires = BrepWireframe(Brep=brep, Density=-1)
area = Area(Geometry=srf)  # -> Area, Centroid
preview = CustomPreview(Geometry=[srf_2, srf], Shader=ColourSwatch(SwatchColor=RGBA(136, 191, 255, 77)))
vdis = VectorDisplay(Anchor=area.Centroid, Vector=vec.Vector)
jagged = SettingsSpeed()
Y = UnitY(Factor=1)
pt = Point(Point(4.51574388, 2.967695353, 3.602823551))
meshparams = Butterfly_MeshingParameters(cellSizeXYZ="{0.2, 0.2, 0.1}")  # -> readMe, meshParams; plug-in component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
createbfgeometry = Butterfly_CreateButterflyGeometry(name="west_window", geo=flatten(srf), boundary=inlet, meshSet=jagged)  # -> readMe, BFGeometries; plug-in component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
createbfgeometry_2 = Butterfly_CreateButterflyGeometry(name="room", geo=flatten(brep), boundary=wall, meshSet=jagged)  # -> readMe, BFGeometries; plug-in component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
createbfgeometry_3 = Butterfly_CreateButterflyGeometry(name="east_window", geo=flatten(srf_2), boundary=outlet, meshSet=jagged)  # -> readMe, BFGeometries; plug-in component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
make2dparams = Butterfly_Make2dParameters(origin=pt, normal=Y, width="1")  # -> readMe, make2dParams; plug-in component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
# 1. CREATE OPENFOAM CASE
panel_4 = Panel("indoor_airflow_2d")
number_slider = Slider(2, range=0..10)

# ---- group: Create and write the case!
casefromgeos = Butterfly_CreateCaseFromGeometries(
    name=panel_4,
    BFGeometries=flatten([createbfgeometry_2.BFGeometries, createbfgeometry_3.BFGeometries, createbfgeometry.BFGeometries]),
    make2dParams=make2dparams.make2dParams,
    meshParams=meshparams.meshParams,
    run=Toggle(False))  # -> readMe, case; plug-in component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

# ----
toggle = BooleanToggle(False)
# PURGE CASE
purgecase = Butterfly_purgeCase(case=casefromgeos.case, blockMesh=False, snappyHexMesh=False, results=toggle, postProcessing=toggle)  # -> readMe; plug-in component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
# 2.1. BLOCKMESH
blockmesh = Butterfly_blockMesh(case=casefromgeos.case, overwrite=True, run=Toggle(False))  # -> readMe, case; plug-in component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

# ---- group: update inlet wind velocity
panel_5 = Panel("""boundaryField
{

west_window
    {

  
value		uniform (1.5 0.0 0.0);

}
}""")
panel_6 = Panel("U")

# ----
panel_7 = Panel("C:\Users\Mostapha\Documents\code\ladybug-analysis-tools\butterfly\plugin\grasshopper")
brep_2 = Brep(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)
gentestpts = Honeybee_GenerateTestPoints(testGeometry=brep_2, gridSize=Slider(0.3, range=0..1), distBaseSrf="0.05", moveTestMesh=Toggle(False))  # -> readMe, simplify(testPoints), simplify(ptsVectors), simplify(facesArea), simplify(mesh); plug-in component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

# ---- group: sample the box in 3D
bbox = BoundingBox(Content=brep, Plane=PlaneXY(0, 0, 0), UnionBox=True)  # -> Box, Box_2
range = Range(Domain=Domain(0.05, 0.95), Steps=10)
crossref = CrossReference(ListA=range, ListB=range, ListC=range, CrossMode=1)  # -> ListA, ListB, ListC
box = EvaluateBox(Box=bbox.Box, UParameter=crossref.ListA, VParameter=crossref.ListB, WParameter=crossref.ListC)  # -> Plane, Point, Include

# ----
# 2. MESHING
# 2.2. SNAPPYHEXMESH
snappyhexmesh = Butterfly_snappyHexMesh(case=blockmesh.case, run=Toggle(False))  # -> readMe, case; plug-in component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
panel_8 = Panel("""p
U""")
flatten = FlattenTree(Tree=gentestpts.mesh, Path="{0}")
flatten_2 = FlattenTree(Tree=gentestpts.testPoints, Path="{0}")
controldict = Butterfly_controlDict(startTime=0, endTime="5000", writeInterval=100, writeCompression=False)  # -> controlDict; plug-in component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
probes = Butterfly_probes(pts=flatten_2, fields=panel_8)  # -> probes; plug-in component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
decomposepardict = Butterfly_decomposeParDict(mode=0, numOfCpus="2")  # -> decomposeParDict; plug-in component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
solutionparam = Butterfly_SolutionParameter(filename=panel_6, values=panel_5, replace=False)  # -> solutionParam; plug-in component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
exportladybug = Ladybug_ExportLadybug(targetFolder=panel_7, export=Toggle(False))  # -> readMe; plug-in component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
# VISUALIZE MESH
loadmesh = Butterfly_LoadMesh(case=snappyhexmesh.case, innerMesh=False, load=Toggle(False))  # -> mesh; plug-in component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
faceb = FaceBoundaries(Mesh=loadmesh)
solutionparams = Butterfly_SolutionParameters(controlDict=controldict, probes=probes, additionalParams=solutionparam)  # -> solutionParams; plug-in component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
steadyincomp = Butterfly_SteadyIncompressibleRecipe()  # -> readMe, recipe; plug-in component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
# 3. SOLUTION
solution = Butterfly_Solution(
    case=snappyhexmesh.case,
    recipe=steadyincomp.recipe,
    solutionParams=solutionparams,
    interval=2,
    write=Toggle(False),
    run=Toggle(True))  # -> readMe, solution, isRunning, timestep, residualFields, residualValues, logFiles; plug-in component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
# PLOT RESIDUALS
panel_9 = Panel(solution.residualFields)
loadprobesvalue = Butterfly_LoadProbesValue(solution=solution.solution, field="p")  # -> values; plug-in component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
loadprobesvalue_2 = Butterfly_LoadProbesValue(solution=solution.solution, field="U")  # -> values; plug-in component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
panel_10 = Panel(solution.residualValues)

# ---- group: points
pt_2 = Point(flatten_2)

# ---- group: vectors
vec_2 = Vector(loadprobesvalue_2)

# ----
rec = Rectangle({Plane=PlaneXY(1, -6, 0), Size=Domain2(u=0..15, v=0..5)})
mjoin = MeshJoin(Meshes=flatten)
plotresiduals = Butterfly_PlotResiduals(solution=solution.solution, rect=rec, targetRes=0.0001, port=0.1, method=0, load=Toggle(False))  # -> readMe, timeRange, curves, port, residualLine, colors; plug-in component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
gradientlibrary = Ladybug_GradientLibrary(gradIndex="7")  # -> customColors; plug-in component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
preview_2 = CustomPreview(Geometry=plotresiduals.curves, Shader=plotresiduals.colors)
panel_11 = Panel(plotresiduals.readMe)
# 4. RESULT VISUALIZATION
legendpar = Ladybug_LegendParameters(customColors=flatten(gradientlibrary))  # -> legendPar; plug-in component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
ladybug = Ladybug_Ladybug()  # -> Vviiiiiiiiiizzz; plug-in component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
recolormesh = Ladybug_RecolorMesh(analysisResult=loadprobesvalue, inputMesh=mjoin, legendPar=legendpar, analysisTitle="Pressure.", legendTitle="Pa.")  # -> readMe, newMesh, newLegend, legendBasePt, meshColors, legendColors; plug-in component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
scale = Slider(0.22, range=0..1)
faceb_2 = FaceBoundaries(Mesh=recolormesh.newMesh)
mesh = Mesh(recolormesh.newLegend)
multiplication = Multiplication(A=vec_2, B=scale)
preview_3 = CustomPreview(Geometry=faceb_2, Shader=recolormesh.meshColors)
vdisex = VectorDisplayEx(Point=pt_2, Vector=multiplication, Colour=recolormesh.meshColors, Width=Slider(2, range=0..5))
