# Grasshopper definition outdoor_airflow.gh (Grasshopper 0.9.76)
# plug-ins: Python Interpreter

panel = Panel("""(39.358626365661635 -12.130292415618825 28.252584457397461)
(39.358626365661635 139.49590921401983 0.0)
(-7.912170410156236 -12.130292415618825 0.0)
(-7.912170410156236 139.49590921401983 28.252584457397461)
(39.358626365661635 -12.130292415618825 0.0)
(39.358626365661635 139.49590921401983 28.252584457397461)
(-7.912170410156236 139.49590921401983 0.0)
(-7.912170410156236 -12.130292415618825 28.252584457397461)""")
brep = Brep([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])
panel_2 = Panel("""20
60
20""")
panel_3 = Panel("""0.1
0.3
0.6""")

# ---- group: create refinement region
number_slider = Slider(1.5, range=0..10)
bbox = BoundingBox(Content=brep, Plane=PlaneXY(0, 0, 0), UnionBox=True)  # -> Box, Box_2
area = Area(Geometry=bbox.Box)  # -> Area, Centroid
project = Project(Geometry=area.Centroid, Plane=PlaneXY(0, 0, 0))  # -> Geometry, Transform
scale_nu = ScaleNU(Geometry=bbox.Box, Plane=project.Geometry, ScaleX=number_slider, ScaleY=number_slider, ScaleZ=number_slider)  # -> Geometry, Transform

# ----
seggrading = Butterfly_SegmentGrading(percentageLength=panel_3, percentageCells=panel_2, expansionRatio=1)  # -> segmentGrading; plug-in component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
python = PythonScript(x=panel)  # -> out, a
# ---------- python: Python ----------
a = x.replace(' ', ',').replace('(', '{').replace(')', '}')
# ---------- end python ----------
wall = Butterfly_WallBoundary(refLevels="(1, 4)")  # -> wallBoundary; plug-in component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
pt = Point(python.a)
multigrading = Butterfly_MultiGrading(segmentGradings=flatten(seggrading))  # -> grading; plug-in component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
points = PointList(Points=pt, Size=Slider(5, range=0..10))
wires = BrepWireframe(Brep=scale_nu.Geometry, Density=-1)
# 0. Create BF surface
panel_4 = Panel("buildings")
jagged = SettingsSpeed()
inoutrefmode = Butterfly_LocationRefinementMode(mode=0, level="4")  # -> locationRefMode; plug-in component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
createbfgeometry = Butterfly_CreateButterflyGeometry(geo=flatten(brep), name=panel_4, boundary=wall, meshSet=jagged)  # -> readMe, BFGeo; plug-in component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
gradxyz = Butterfly_GradingXYZ(xGrading=1, yGrading=multigrading, zGrading=1)  # -> gradXYZ; plug-in component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
jagged_2 = SettingsSpeed()
# 1. Wind Tunnel Parameters
panel_5 = Panel("{5,30,10}")
refinementregion = Butterfly_RefinementRegion(geo=flatten(scale_nu.Geometry), name="between_bldgs", refMode=inoutrefmode, meshSet=jagged_2)  # -> readMe, refinementRegion; plug-in component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
panel_6 = Panel(gradxyz)

# ---- group: create test surface in pedestrian level
debrep = DeconstructBrep(Brep=scale_nu.Geometry)  # -> Faces, Edges, Vertices
item = ListItem(List=debrep.Faces, Index=4, Wrap=True)
Z = UnitZ(Factor="1.2")
xy = XYPlane(Origin=Z)
move = Move(Geometry=item, Motion=Z)  # -> Geometry, Transform
wires_2 = BrepWireframe(Brep=move.Geometry, Density=-1)
sec = BrepPlane(Brep=brep, Plane=xy)  # -> Curves, Points
join = JoinCurves(Curves=wires_2, Preserve=False)
boundary = BoundarySurfaces(Edges=flatten([join, sec.Curves]))

# ----
windtunnelpar = Butterfly_WindTunnelParameters(windwardX=3, topX=3, sidesX=2, leewardX=15, cellSizeXYZ=panel_5, gradXYZ=gradxyz)  # -> readMe, tunnelPar; plug-in component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
# 2. Create the Wind Tunnel
panel_7 = Panel("outdoor_airflow")

debrep_2 = DeconstructBrep(Brep=scale_nu.Geometry)  # -> Faces, Edges, Vertices
item_2 = ListItem(List=debrep_2.Faces, Index=5, Wrap=True)
area_2 = Area(Geometry=item_2)  # -> Area, Centroid
move_2 = Move(Geometry=area_2.Centroid, Motion=Vector(0, 0, 3))  # -> Geometry, Transform
pt_2 = Point(area_2.Centroid)
tag = TextTag(Location=move_2.Geometry, Text="Refinement Region")

createcasefromtunnel = Butterfly_CreateCaseFromTunnel(
    name=panel_7,
    BFGeometries=flatten(createbfgeometry.BFGeo),
    windSpeed="2",
    refWindHeight=10,
    landscape=1,
    globalRefLevel="(2, 2)",
    refRegions=refinementregion.refinementRegion,
    tunnelPar=windtunnelpar.tunnelPar,
    run=Toggle(True))  # -> readMe, geo, case; plug-in component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

debrep_3 = DeconstructBrep(Brep=createcasefromtunnel.geo)  # -> Faces, Edges, Vertices
item_3 = ListItem(List=debrep_3.Faces, Index=5, Wrap=True)
area_3 = Area(Geometry=item_3)  # -> Area, Centroid
move_3 = Move(Geometry=area_3.Centroid, Motion=Vector(0, 0, 3))  # -> Geometry, Transform
pt_3 = Point(area_3.Centroid)
tag_2 = TextTag(Location=move_3.Geometry, Text="Wind Tunnel")

wires_3 = BrepWireframe(Brep=createcasefromtunnel.geo, Density=-1)
panel_8 = Panel(createcasefromtunnel.readMe)
toggle = BooleanToggle(False)
blockmesh = Butterfly_blockMesh(case=createcasefromtunnel.case, purge=Toggle(True), run=Toggle(True))  # -> readMe, case; plug-in component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
# purgeCase
purgecase = Butterfly_purgeCase(case=createcasefromtunnel.case, blockMesh=False, snappyHexMesh=False, results=toggle, postProcessing=toggle)  # -> readMe; plug-in component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
brep_2 = Brep([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])
brep_3 = Brep(boundary)

# ---- group: case
data = Data(blockmesh.case)

# ----
gentestpts = Honeybee_GenerateTestPoints(testGeometry=[brep_3, brep_2], gridSize=Slider(1, range=0..1), distBaseSrf="0.05", moveTestMesh=Toggle(False))  # -> readMe, simplify(testPoints), simplify(ptsVectors), simplify(facesArea), simplify(mesh); plug-in component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
# Load mesh/points
toggle_2 = BooleanToggle(True)
loadmesh = Butterfly_LoadMesh(case=data, load=toggle_2)  # -> mesh; plug-in component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
panel_9 = Panel("""U
p""")
loadpoints = Butterfly_LoadPoints(case=data, load=Toggle(False))  # -> pts; plug-in component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
flatten = FlattenTree(Tree=gentestpts.testPoints, Path="{0}")
controldict = Butterfly_controlDict(startTime=0, endTime="500", writeInterval="100", writeCompression=False)  # -> controlDict; plug-in component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
faceb = FaceBoundaries(Mesh=loadmesh)
residualcontrol = Butterfly_residualControl(p="0.0001", U="0.0001", k="0.0001", epsilon="0.0001")  # -> residualControl; plug-in component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
probes = Butterfly_probes(pts=flatten, fields=panel_9)  # -> probes; plug-in component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
ras = Butterfly_RASTurbulanceModel(RASModel="RNGkEpsilon", turbulence=True, printCoeffs=True)  # -> RAS; plug-in component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
solutionparams = Butterfly_SolutionParameters(controlDict=controldict, residualControl=residualcontrol, probes=probes)  # -> readMe, solutionParams; plug-in component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
decomposepardict = Butterfly_decomposeParDict(mode=0, numOfCpus="2")  # -> decomposeParDict; plug-in component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

# ---- group: points
pt_4 = Point(flatten)

# ----
# Results visualization
flatten_2 = FlattenTree(Tree=gentestpts.mesh, Path="{0}")
mjoin = MeshJoin(Meshes=flatten_2)
ladybug = Ladybug_Ladybug()  # -> Vviiiiiiiiiizzz; plug-in component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

# ----
# 0. blockMesh
# 1. snappyHexMesh
panel_10 = Panel("2")
snappyhexmeshdict = Butterfly_snappyHexMeshDict(castellatedMesh=True, snap=True, addLayers=False, maxGlobalCells=2000000)  # -> snappyHexMeshDict; plug-in component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

decomposepardict_2 = Butterfly_decomposeParDict(mode=0, numOfCpus=panel_10)  # -> decomposeParDict; plug-in component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

snappyhexmesh = Butterfly_snappyHexMesh(case=blockmesh.case, decomposeParDict=decomposepardict_2, run=Toggle(False))  # -> readMe, case; plug-in component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
# 1.1. checkMesh
chekmesh = Butterfly_chekMesh(case=snappyhexmesh.case, run=Toggle(True))  # -> readMe, case, maxNonOrthogonality; plug-in component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
# Meshing
panel_11 = Panel(chekmesh.readMe)

# ----
# 2. Recipe
steadyincomp = Butterfly_SteadyIncompressibleRecipe(case=chekmesh.case, turbulenceProp=ras)  # -> readMe, recipe; plug-in component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
panel_12 = Panel(steadyincomp.recipe)
# 3. Solution
solution = Butterfly_Solution(
    recipe=steadyincomp.recipe,
    solutionParams=solutionparams.solutionParams,
    interval="5",
    write=Toggle(False),
    run=Toggle(False))  # -> readMe, solution, status, logFiles; plug-in component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
panel_13 = Panel(solution.readMe)
watchprobes = Butterfly_WatchProbes(solution=solution.solution, field="p")  # -> values; plug-in component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
watchprobes_2 = Butterfly_WatchProbes(solution=solution.solution, field="U")  # -> values; plug-in component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
watchres = Butterfly_WatchResiduals(solution=solution.solution)  # -> readMe, residualValues; plug-in component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
tracker = ValueTracker(
    watchres.residualValues,
    TrackerAutoDomain=True,
    TrackerColour=RGB(255, 155, 0),
    TrackerPeriod=300,
    TrackerUpdate=25,
    TrackerDomain=[0, 1])
panel_14 = Panel(watchres.readMe)
panel_15 = Panel(watchres.residualValues)

# ---- group: vectors
vec = Vector(watchprobes_2)

# ----
recolormesh = Ladybug_RecolorMesh(analysisResult=watchprobes, inputMesh=mjoin, analysisTitle="p")  # -> readMe, newMesh, newLegend, legendBasePt, meshColors, legendColors; plug-in component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

vlen = VectorLength(Vector=vec)
bnd = Bounds(Numbers=vlen)
remap = RemapNumbers(Value=vlen, Source=bnd, Target=Domain(1, 0))  # -> Mapped, Clipped
gradient = Gradient(
    LowerLimit=0,
    UpperLimit=1,
    Parameter=remap.Mapped,
    stops=[0: RGB(234, 38, 0), 0.25: RGB(234, 126, 0), 0.5: RGB(254, 244, 84), 0.75: RGB(173, 203, 249), 1: RGB(75, 107, 169)])

dedomain = DeconstructDomain(Domain=bnd)  # -> Start, End

division = Division(A=dedomain.End, B="3")
division_2 = Division(A=vec, B=division)
vdisex = VectorDisplayEx(Point=pt_4, Vector=division_2, Colour=gradient, Width=Slider(2, range=0..5))
